# Grasshopper definition ghPython_009.gh (Grasshopper 1.0.7)

number_slider = Slider(5, range=0..10)
number_slider_2 = Slider(3, range=0..10)
# Understanding Why Using a Class is Important
# 
# Object-Oriented Programming (OOP)
# 1. Encapsulation
# 2. Inheritance
# 3. Polymorphism
# 
# Here are the reasons to use a class to hold your matrix routines:
# 1. Organization
# 2. Ease to access
# 3. Esier development
# 4. Collision elimination
# 5. Cohesiveless
# Building the Basic Class
# 
# The Matrix class is written with simplicity in mind.
# 
# It doesn't include type checking code, matrix size or error trapping.
# 
# Creating a matrix
# 
# The Matrix constructor allows the creation of blank matrixes of a certain size,
# or matrixes that already have values initialized using a Python list.
# When creating a blank matrix,
# the code fills the values with None so that it's easy to check for initialization.
# 
# Two-dimensional matrix is a good foundation.
# 
# i.e. class Matrix:
number_slider_3 = Slider(3, range=0..10)
# ALGORITHMS for Dummies TRANSLATED IN TO GRASSHOPPER FOR RHINO3D, Chapter 5: Developing a Matrix Computation Class
# NumPy ranks in the top ten Python libraries.
# 
# There are reasons not to use numpy and to create your own class to perform at least the basic matrix manipulation tasks.
# 
# This will help you understand what's involved in creating such a class.
# 
# You may need to know how to flatten your matrix for certain types of calculations.
# 
# Source code is available online, however it will need to be fit to the grasshopper ghpython component to work in Rhino3D.
# Avoiding the Use of NumPy
# 
# Updates may charge your application to fail.
# 
# Coplexity at 486 page user guide.
# 
# Changes are difficult to make.
# 
# NumPOy requires C/C++ in addition to Python.
# rely on C++ arrays, rather than Pythons doubly linked lists.
# 
# Difficult
# 
# NumPy uses values that Python doesn't understand.  i.e. NAN
# 
# Using a contiguous range of memory slows things down.
matrix_class = GhPythonScript(numRows=number_slider_3, numColumns=Slider(2, range=0..10))  # -> out, c; inputs numRows: Int32, numColumns: Int32
# ---------- matrix_class: Python ----------
__author__ = "Sculpture"
__version__ = "2022.06.04"

import rhinoscriptsyntax as rs
import scriptcontext as sc
import ghpythonremote
# Grasshopper does not recognize remote list objects as list:
from ghpythonlib.treehelpers import list_to_tree #rhino 6,7 only!
np = sc.sticky['numpy']
rpy = sc.sticky['rpy']


class Matrix:
    rows = 0
    columns = 0
    matrix = []
    matrixRow = []
    dataCount = 0
    matrixList = []
    tempProduct = 0
    
    
    def __init__(self, Rows, Columns, Data = []):
        if Data == []:
            Data = [None] * (Rows * Columns)
        self.matrix = []
        self.rows = Rows
        self.columns = Columns
        for i in range(Rows):
            self.matrixRow = []
            for j in range(Columns):
                self.matrixRow.append(Data[self.dataCount])
                self.dataCount += 1
            self.matrix.append(self.matrixRow)


myMatrix = Matrix(numRows, numColumns)
print(myMatrix.rows)
print(myMatrix.columns)
print(myMatrix.matrix)
print(type(myMatrix.matrix))

c= (myMatrix.matrix)
c = list_to_tree(c, source=[0,0])
# ---------- end matrix_class ----------
matrix_class_2 = GhPythonScript(numRows=number_slider, numColumns=number_slider_2)  # -> out, nullMatrix, customMatrix; inputs numRows: Int32, numColumns: Int32
# ---------- matrix_class_2: Python ----------
__author__ = "Sculpture"
__version__ = "2022.06.04"

import rhinoscriptsyntax as rs
import scriptcontext as sc
import ghpythonremote
# Grasshopper does not recognize remote list objects as list:
from ghpythonlib.treehelpers import list_to_tree #rhino 6,7 only!
np = sc.sticky['numpy']
rpy = sc.sticky['rpy']


class Matrix:
    rows = 0
    columns = 0
    matrix = []
    matrixRow = []
    dataCount = 0
    matrixList = []
    tempProduct = 0
    
    
    def __init__(self, Rows, Columns, Data = []):
        if Data == []:
            Data = [None] * (Rows * Columns)
        self.matrix = []
        self.rows = Rows
        self.columns = Columns
        for i in range(Rows):
            self.matrixRow = []
            for j in range(Columns):
                self.matrixRow.append(Data[self.dataCount])
                self.dataCount += 1
            self.matrix.append(self.matrixRow)


myMatrix = Matrix(numRows, numColumns)
print(myMatrix.rows)
print(myMatrix.columns)
print(myMatrix.matrix)
print(type(myMatrix.matrix))

# null matrix
nullMatrix = (myMatrix.matrix)
nullMatrix = list_to_tree(nullMatrix, source=[0,0])

#custom matrix
z = list(range(numRows * numColumns))
print(z)
myMatrix2 = Matrix(numRows, numColumns, z)
print(myMatrix2.matrix)

customMatrix = (myMatrix2.matrix)
customMatrix = list_to_tree(customMatrix, source=[0,0])
# ---------- end matrix_class_2 ----------
# Accessing specific matrix elements
# 
# Performing scalar and matrix addition
# 
# Performing multiplication
# 1. Element-wise product
# 2. Dot product
# 
# Manipulating the Matrix
# 1. Transposing a matrix
# 2. Calculating the determinant
# 
# Flattening the matrix
matrix_class_3 = GhPythonScript(numRows=number_slider, numColumns=number_slider_2)  # -> out, nullMatrix, customMatrix; inputs numRows: Int32, numColumns: Int32; same code as matrix_class_2
panel = Panel(matrix_class.out)
panel_2 = Panel(matrix_class.c)
panel_3 = Panel(matrix_class_2.nullMatrix)
panel_4 = Panel(matrix_class_2.out)
panel_5 = Panel(matrix_class_2.customMatrix)
