# Grasshopper definition ghPython_010.gh (Grasshopper 1.0.7)

number_slider = Slider(5, range=0..10)
number_slider_2 = Slider(2, range=0..10)
# Understanding Why Using a Class is Important
# 
# Object-Oriented Programming (OOP)
# 1. Encapsulation
# 2. Inheritance
# 3. Polymorphism
# 
# Here are the reasons to use a class to hold your matrix routines:
# 1. Organization
# 2. Ease to access
# 3. Esier development
# 4. Collision elimination
# 5. Cohesiveless
# Building the Basic Class
# 
# The Matrix class is written with simplicity in mind.
# 
# It doesn't include type checking code, matrix size or error trapping.
# 
# Creating a matrix
# 
# 
# 
# The Matrix constructor allows the creation of blank matrixes of a certain size,
# or matrixes that already have values initialized using a Python list.
# When creating a blank matrix,
# the code fills the values with None so that it's easy to check for initialization.
# 
# Two-dimensional matrix is a good foundation.
# 
# i.e. class Matrix:
# 
# Even though NumPy doesn't provide a direct
# method of specifying the matrix shape during
# the initialization, it does provide the reshape()
# function to do after initialization.
# 
# The Matrix class provides a fixed size.
# 
# There is no best way to accomplish tasks.
number_slider_3 = Slider(3, range=0..10)
matrix_class = GhPythonScript(numRows=number_slider_3, numColumns=Slider(2, range=0..10))  # -> out, c; inputs numRows: Int32, numColumns: Int32
# ---------- matrix_class: Python ----------
__author__ = "Sculpture"
__version__ = "2022.06.04"

import rhinoscriptsyntax as rs
import scriptcontext as sc
import ghpythonremote
# Grasshopper does not recognize remote list objects as list:
from ghpythonlib.treehelpers import list_to_tree #rhino 6,7 only!
np = sc.sticky['numpy']
rpy = sc.sticky['rpy']


class Matrix:
    rows = 0
    columns = 0
    matrix = []
    matrixRow = []
    dataCount = 0
    matrixList = []
    tempProduct = 0
    
    
    def __init__(self, Rows, Columns, Data = []):
        if Data == []:
            Data = [None] * (Rows * Columns)
        self.matrix = []
        self.rows = Rows
        self.columns = Columns
        for i in range(Rows):
            self.matrixRow = []
            for j in range(Columns):
                self.matrixRow.append(Data[self.dataCount])
                self.dataCount += 1
            self.matrix.append(self.matrixRow)


myMatrix = Matrix(numRows, numColumns)
print(myMatrix.rows)
print(myMatrix.columns)
print(myMatrix.matrix)
print(type(myMatrix.matrix))

c= (myMatrix.matrix)
c = list_to_tree(c, source=[0,0])
# ---------- end matrix_class ----------
matrix_class_2 = GhPythonScript(numRows=number_slider, numColumns=number_slider_2)  # -> out, nullMatrix, customMatrix; inputs numRows: Int32, numColumns: Int32
# ---------- matrix_class_2: Python ----------
__author__ = "Sculpture"
__version__ = "2022.06.04"

import rhinoscriptsyntax as rs
import scriptcontext as sc
import ghpythonremote
# Grasshopper does not recognize remote list objects as list:
from ghpythonlib.treehelpers import list_to_tree #rhino 6,7 only!
np = sc.sticky['numpy']
rpy = sc.sticky['rpy']


class Matrix:
    rows = 0
    columns = 0
    matrix = []
    matrixRow = []
    dataCount = 0
    matrixList = []
    tempProduct = 0
    
    
    def __init__(self, Rows, Columns, Data = []):
        if Data == []:
            Data = [None] * (Rows * Columns)
        self.matrix = []
        self.rows = Rows
        self.columns = Columns
        for i in range(Rows):
            self.matrixRow = []
            for j in range(Columns):
                self.matrixRow.append(Data[self.dataCount])
                self.dataCount += 1
            self.matrix.append(self.matrixRow)


myMatrix = Matrix(numRows, numColumns)
print(myMatrix.rows)
print(myMatrix.columns)
print(myMatrix.matrix)
print(type(myMatrix.matrix))

# null matrix
nullMatrix = (myMatrix.matrix)
nullMatrix = list_to_tree(nullMatrix, source=[0,0])

#custom matrix
z = list(range(numRows * numColumns))
print(z)
myMatrix2 = Matrix(numRows, numColumns, z)
print(myMatrix2.matrix)

customMatrix = (myMatrix2.matrix)
customMatrix = list_to_tree(customMatrix, source=[0,0])
# ---------- end matrix_class_2 ----------
matrix_class_3 = GhPythonScript(numRows=number_slider, numColumns=number_slider_2)  # -> out, nullMatrix, customMatrix; inputs numRows: Int32, numColumns: Int32; same code as matrix_class_2
panel = Panel(matrix_class.out)
panel_2 = Panel(matrix_class.c)
panel_3 = Panel(matrix_class_2.nullMatrix)
panel_4 = Panel(matrix_class_2.out)
panel_5 = Panel(matrix_class_2.customMatrix)
# Avoiding the Use of NumPy
# 
# Updates may charge your application to fail.
# 
# Coplexity at 486 page user guide.
# 
# Changes are difficult to make.
# 
# NumPOy requires C/C++ in addition to Python.
# rely on C++ arrays, rather than Pythons doubly linked lists.
# 
# Difficult
# 
# NumPy uses values that Python doesn't understand.  i.e. NAN
# 
# Using a contiguous range of memory slows things down.
number_slider_4 = Slider(2, range=0..10)
# ALGORITHMS for Dummies TRANSLATED IN TO GRASSHOPPER FOR RHINO3D, Chapter 5: Developing a Matrix Computation Class
# NumPy ranks in the top ten Python libraries.
# 
# There are reasons not to use numpy and to create your own class to perform at least the basic matrix manipulation tasks.
# 
# This will help you understand what's involved in creating such a class.
# 
# You may need to know how to flatten your matrix for certain types of calculations.
# 
# Source code is available online, however it will need to be fit to the grasshopper ghpython component to work in Rhino3D.
# Performing scalar and matrix addition
number_slider_5 = Slider(3, range=0..10)
matrix_class_4 = GhPythonScript(
    numRows=number_slider_5,
    numColumns=Slider(3, range=0..10),
    row=number_slider_4,
    column=Slider(1, range=0..10),
    addNum=Slider(10, range=0..10))  # -> out, nullMatrix, customMatrix, matrixElements1, matrixElements2, addNumOut; inputs numRows: Int32, numColumns: Int32, row: Int32, column: Int32
# ---------- matrix_class_4: Python ----------
__author__ = "Sculpture"
__version__ = "2022.06.04"

import rhinoscriptsyntax as rs
import scriptcontext as sc
import ghpythonremote
# Grasshopper does not recognize remote list objects as list:
from ghpythonlib.treehelpers import list_to_tree #rhino 6,7 only!
np = sc.sticky['numpy']
rpy = sc.sticky['rpy']


class Matrix:
    rows = 0
    columns = 0
    matrix = []
    matrixRow = []
    dataCount = 0
    matrixList = []
    tempProduct = 0
    
    
    def __init__(self, Rows, Columns, Data = []):
        if Data == []:
            Data = [None] * (Rows * Columns)
        self.matrix = []
        self.rows = Rows
        self.columns = Columns
        for i in range(Rows):
            self.matrixRow = []
            for j in range(Columns):
                self.matrixRow.append(Data[self.dataCount])
                self.dataCount += 1
            self.matrix.append(self.matrixRow)
    
    
    #Accessing specific matrix elements
    def __getitem__(self, index):
        return self.matrix[index]
    
    
    # use the __add__ method
    def __add__(self, Value):
        self.matrixList = []
        if type(Value) == list:
            for i in range(self.rows):
                for j in range(self.columns):
                    self.matrixList.append(self.matrix[i][j] + Value[i][j])
        else:
            for i in range(self.rows):
                for j in range(self.columns):
                    self.matrixList.append(self.matrix[i][j] + Value)
        return Matrix(self.rows, self.columns, self.matrixList)



myMatrix = Matrix(numRows, numColumns)
print(myMatrix.rows)
print(myMatrix.columns)
print(myMatrix.matrix)
print(type(myMatrix.matrix))

# null matrix
nullMatrix = (myMatrix.matrix)
nullMatrix = list_to_tree(nullMatrix, source=[0,0])

#custom matrix
z = list(range(numRows * numColumns))
print(z)
myMatrix2 = Matrix(numRows, numColumns, z)
print(myMatrix2.matrix)

customMatrix = (myMatrix2.matrix)
customMatrix = list_to_tree(customMatrix, source=[0,0])

#Accessing specific matrix elements
print(myMatrix2[1])
print(myMatrix2[1][2])

if (row < numRows) and (column < numColumns):
    matrixElements1 = (myMatrix2[row])
    matrixElements2 = (myMatrix2[row][column])
else:
    print("index out of range")

myMatrix2 += addNum
print(myMatrix2.matrix)
addNumOut = (myMatrix2.matrix)
print type(myMatrix2.matrix)
addNumOut = list_to_tree(addNumOut, source=[0,0])

if (numRows and numColumns) == 3:
    myMatrix2 += [[2,4,6],[8,10,12],[20, 30, 40]]
else:
    print("index out of range")
print(myMatrix2.matrix)
print type(myMatrix2.matrix)
# ---------- end matrix_class_4 ----------
panel_6 = Panel(matrix_class_4.out)
panel_7 = Panel(matrix_class_4.nullMatrix)
panel_8 = Panel(matrix_class_4.addNumOut)
panel_9 = Panel(matrix_class_4.customMatrix)
panel_10 = Panel(matrix_class_4.matrixElements1)
panel_11 = Panel(matrix_class_4.matrixElements2)
# Performing multiplication
# 1. Element-wise product
# 2. Dot product
number_slider_6 = Slider(3, range=0..10)
matrix_class_5 = GhPythonScript(
    numRows=number_slider_6,
    numColumns=Slider(3, range=0..10),
    row=Slider(2, range=0..10),
    column=Slider(1, range=0..10),
    addNum=Slider(10, range=0..10))  # -> out, nullMatrix, customMatrix, matrixElements1, matrixElements2, addNumOut; inputs numRows: Int32, numColumns: Int32, row: Int32, column: Int32; same code as matrix_class_4
panel_12 = Panel(matrix_class_5.out)
panel_13 = Panel(matrix_class_5.nullMatrix)
panel_14 = Panel(matrix_class_5.addNumOut)
panel_15 = Panel(matrix_class_5.customMatrix)
panel_16 = Panel(matrix_class_5.matrixElements1)
# Manipulating the Matrix
# 1. Transposing a matrix
# 2. Calculating the determinant
# 
# Flattening the matrix
panel_17 = Panel(matrix_class_5.matrixElements2)
