# Grasshopper definition ghPython_Algorithms4Dummies_Chapter_4_5.gh (Grasshopper 1.0.7)
# Copyright: © 2017-2018 Pierre Cuvilliers, Caitlin Mueller, Massachusetts Institute of Technology

# ----
# Getting ghpython Remote component up and running.
# ALGORITHMS for Dummies TRANSLATED IN TO GRASSHOPPER FOR RHINO3D, Chapter 4: Performing Calculations Using Vectors and Matrices
# Creating Combinations the Right Way
# 
# Data isn't simply a sequence of numbers__
# it presents a meaningful sequence that,
# when ordered the proper way,
# conveys information to the viewer.
# The goal of mathematical algorithms is to turn one kind of data into another kind of data.\
# 
# Time to learn how to create your own library  of hand-coded algorithms.
# 
# Discover how to speed up the calculations so that you spend less time manipulating
# the date and more time doing something really interesting with it.
# Performing Tasks More Quickly
# 
# Considering divide and conquer
# 
# 1. split the content in question in half.
# 2. Compare the keys for the content with the serach term.
# 3. Choose the half that contains the key.
# 4. Repeat Steps 1 through 3 until you find the key.
# 
# Binary serach that assumes you have a sorted list.
# Explaining Recursion
# In recursion, you call a Python function,
# it does something,
# and then it calls itself repeatedly until it reaches a specific condition-
# but all those previous calls are still active.
# The calls unwind themselves one at a time until the first call finally ends with the correct answer,
# and this unwinding process is where most people encounter a problem.
# Performing vector multiplication
# 
# You need to use the dot product, which is the sum of the products of two sequences.
# 
# the dotproduct is always the sum of individual element-by-element multiplications and results in a single number.
# 
# Creating a matrix is the right way to start.
# 
# Simply use the array() function as you would with a vector, but you define additional dimensions.
# 
# rows (one direction)
# columns (second direction)
# Permutations, combinations and repetitions.
# 
# Distinguishing permutations
# 
# Creating a data permutation, a reordering of the data so that it presents a different view,
# might help to acheive a desired result.
# 
# numpy random.permutation() function
# Performing Calculations Using Vectors and Matrices
# 
# Scalar i..e. 2
# Vector i.e. a list of numbers [2,3,4] one dimensional array
# Matrix i.e. rows of lists
#  [[2,3,4],
#   [5,6,7],
#   [8,9,0]]
# NumPy package (http://numpy.org/)
# 
# import numpy as np
# i.e.
# myShort = np.short(15)
# #a value that is 16 bits long
# The conditions for ending recursion haven't been met,
# so the function must call itself again.
# The conditions for ending recursion have been met,
# so the function returns a final value that is used to calculate the ending result.
# It's important to realize that there isn't just one methon for using recursion to solve a problem.
# Here's another version of the factorial recursion that uses fewer lines of code.
# Let's have a look at numpy array() in the grasshopper canvas and the ghpython remote component.
# Shuffling combinations
# 
# Sometimes you really need just a few of the members in combinations of a specific length.
# 
# combinations()
# Dot product works completely differently with matrixes.
# In this case,
# the number in the matrix a must match the number of rows in matrix b.
# However, the # of rows in a can be any munber,
# and the # of columns in b can be any number.
# Eliminating tail call recursion
# Each call consumes memory.
# You can eliminate tail calls from your recursive routines.
# The simplest approach to take when you want to eliminate recursion is to create an interative alternative.
# A while loop replaces the recursive call,
# but your sill need to check for the same condition and continue looping until the data meets the condition.
# random.sample()
# Defining advanced matrix operations
# 
# reshape() function that lets you put the data into any shape needed.
# In fact, you can reshape a vector into a matrix.
# Transposition and inverse of a matrix
# Facing repetitions
# 
# list(set(a))
# Perform Basic Math Functions on Vectors and Matricies
# linalg.inv() and allclose() to compare the dot()
panel = Panel("C:\Users\Sculpture\anaconda3\envs\rhinoremote")
gh_python_remote = GHPythonRemote(location=panel, run=Toggle(True), modules="numpy")  # -> out, linked_modules, rpy, import_statements
ghpython_script = GhPythonScript(rows=Slider(2, range=0..10), columns=Slider(2, range=0..10))  # -> out, myMatrixOut; inputs rows: Int32, columns: Int32
# ---------- ghpython_script: Python ----------
import rhinoscriptsyntax as rs
import scriptcontext as sc
import ghpythonremote
from ghpythonlib.treehelpers import list_to_tree #rhino 6,7 only!
np = sc.sticky['numpy']
rpy = sc.sticky['rpy']

myVect = np.arange(rows * columns).reshape((rows,columns))
print(myVect)
print(type(myVect[0]))

myMatrixOut = myVect
myMatrixOut = ghpythonremote.obtain(myMatrixOut.tolist())
myMatrixOut = list_to_tree(myMatrixOut, source=[0,0])
# ---------- end ghpython_script ----------
ghpython_script_2 = GhPythonScript(addition=Slider(4, range=0..10), rows=Slider(3, range=0..10), columns=Slider(3, range=0..10))  # -> out, myMatrixOut; inputs rows: Int32, columns: Int32
# ---------- ghpython_script_2: Python ----------
import rhinoscriptsyntax as rs
import scriptcontext as sc
import ghpythonremote
from ghpythonlib.treehelpers import list_to_tree #rhino 6,7 only!
np = sc.sticky['numpy']
rpy = sc.sticky['rpy']

myVect = np.arange(rows * columns).reshape((rows,columns))
print(myVect)
print(type(myVect[0]))

myMatrixOut = myVect + addition
print type(myMatrixOut)

myMatrixOut = ghpythonremote.obtain(myMatrixOut.tolist())
print type(myMatrixOut)

myMatrixOut = list_to_tree(myMatrixOut, source=[0,0])
print type(myMatrixOut)
# ---------- end ghpython_script_2 ----------
ghpython_script_3 = GhPythonScript()  # -> Out, A
ghpython_script_4 = GhPythonScript()  # -> out, a, b, c
# ---------- ghpython_script_4: Python ----------
import rhinoscriptsyntax as rs
import scriptcontext as sc
import ghpythonremote
import random
from ghpythonlib.treehelpers import list_to_tree #rhino 6,7 only!
np = sc.sticky['numpy']
rpy = sc.sticky['rpy']

a = np.array([1,2,3,4])
b = np.array([2,2,4,4])

c = (a == b)
print(c)
print(type(c))

a = np.array([1,2,3,4])
a = ghpythonremote.obtain(a.tolist())
a = list_to_tree(a, source=[0,0])

b = np.array([2,2,4,4])
b = ghpythonremote.obtain(b.tolist())
b = list_to_tree(b, source=[0,0])

c = ghpythonremote.obtain(c.tolist())
c = list_to_tree(c, source=[0,0])
# ---------- end ghpython_script_4 ----------
ghpython_script_5 = GhPythonScript(start=Slider(1, range=0..10), end=Slider(10, range=0..10), step=Slider(2, range=0..10))  # -> out, myVectOut; inputs start: Int32, end: Int32, step: Int32
# ---------- ghpython_script_5: Python ----------
__author__ = "Sculpture"
__version__ = "2022.06.02"

import rhinoscriptsyntax as rs
import scriptcontext as sc
import ghpythonremote
from ghpythonlib.treehelpers import list_to_tree #rhino 6,7 only!
np = sc.sticky['numpy']
rpy = sc.sticky['rpy']

myVect = np.arange(start, end, step)
print(myVect)
print(type(myVect[0]))

myVect = np.int16(myVect)
print(myVect)
print(type(myVect[0]))

myVectOut = myVect
myVectOut = ghpythonremote.obtain(myVectOut.tolist())
myVectOut = list_to_tree(myVectOut, source=[0,0])
# ---------- end ghpython_script_5 ----------
ghpython_script_6 = GhPythonScript(a=Slider(2, range=0..10), b=Slider(4, range=0..10), c=Slider(6, range=0..10), d=Slider(9, range=0..10))  # -> out, myVectOut; inputs a: Int32, b: Int32, c: Int32, d: Int32
# ---------- ghpython_script_6: Python ----------
__author__ = "Sculpture"
__version__ = "2022.06.02"

import rhinoscriptsyntax as rs
import scriptcontext as sc
import ghpythonremote
# Grasshopper does not recognize remote list objects as list:
from ghpythonlib.treehelpers import list_to_tree #rhino 6,7 only!
np = sc.sticky['numpy']
rpy = sc.sticky['rpy']

myVect = np.array([a,b,c,d])
print(myVect)
print(type(myVect))

myVectOut = myVect
# They need to be recovered to the local interpreter first:
myVectOut = ghpythonremote.obtain(myVectOut.tolist())
print(type(myVectOut))
myVectOut = list_to_tree(myVectOut, source=[0,0])
print(type(myVectOut))
# ---------- end ghpython_script_6 ----------
panel_2 = Panel(ghpython_script.out)
panel_3 = Panel(ghpython_script.myMatrixOut)
panel_4 = Panel(ghpython_script_2.myMatrixOut)
panel_5 = Panel(ghpython_script_2.out)
panel_6 = Panel(ghpython_script_4.out)
panel_7 = Panel(ghpython_script_4.a)
panel_8 = Panel(gh_python_remote.import_statements)
panel_9 = Panel(ghpython_script_4.b)
panel_10 = Panel(ghpython_script_4.c)
panel_11 = Panel(ghpython_script_6.out)
panel_12 = Panel(ghpython_script_6.myVectOut)
panel_13 = Panel(ghpython_script_5.myVectOut)
panel_14 = Panel(ghpython_script_5.out)
ghpython_script_7 = GhPythonScript()  # -> out, a
# ---------- ghpython_script_7: Python ----------
__author__ = "Sculpture"
__version__ = "2022.06.02"

import rhinoscriptsyntax as rs
import scriptcontext as sc
import ghpythonremote
np = sc.sticky['numpy']
rpy = sc.sticky['rpy']

r_range = ghpythonremote.deliver(rpy, range(100))
print(np.array(r_range))
# ---------- end ghpython_script_7 ----------
ghpython_script_8 = GhPythonScript()  # -> out, a
# ---------- ghpython_script_8: Python ----------
__author__ = "Sculpture"
__version__ = "2022.06.02"

import rhinoscriptsyntax as rs
import scriptcontext as sc
import ghpythonremote
from ghpythonlib.treehelpers import list_to_tree #rhino 6,7 only!
np = sc.sticky['numpy']
rpy = sc.sticky['rpy']

r_range = ghpythonremote.deliver(rpy, range(100))
print(np.array(r_range))

a = np.array(r_range)
print(type(a))
a = ghpythonremote.obtain(a.tolist())
a = list_to_tree(a, source=[0,0])
# ---------- end ghpython_script_8 ----------
panel_15 = Panel(ghpython_script_7.out)
panel_16 = Panel(ghpython_script_7.a)
panel_17 = Panel(ghpython_script_8.out)
panel_18 = Panel(ghpython_script_8.a)
ghpython_script_9 = GhPythonScript()  # -> out, myMatrix
# ---------- ghpython_script_9: Python ----------
__author__ = "Sculpture"
__version__ = "2022.06.02"

import rhinoscriptsyntax as rs
import scriptcontext as sc
import ghpythonremote
from ghpythonlib.treehelpers import list_to_tree #rhino 6,7 only!
np = sc.sticky['numpy']
rpy = sc.sticky['rpy']

a = np.array([[1,2,3], [4,5,6], [7,8,9]])
b = np.array([[1,2,3], [4,5,6], [7,8,9]])
print(a.dot(b))

myMatrix = (a.dot(b))
myMatrix = ghpythonremote.obtain(myMatrix.tolist())
myMatrix = list_to_tree(myMatrix, source=[0,0])

"""
Dot product works completely differently with matrixes.
In this case,
the number in the matrix a must match the number of rows in matrix b.
However, the # of rows in a can be any munber,
and the # of columns in b can be any number.
"""
# ---------- end ghpython_script_9 ----------
ghpython_script_10 = GhPythonScript()  # -> out, myMatrix
# ---------- ghpython_script_10: Python ----------
__author__ = "Sculpture"
__version__ = "2022.06.02"

import rhinoscriptsyntax as rs
import scriptcontext as sc
import ghpythonremote
from ghpythonlib.treehelpers import list_to_tree #rhino 6,7 only!
np = sc.sticky['numpy']
rpy = sc.sticky['rpy']

myMatrix = np.array([[1,2,3], [4,5,6], [7,8,9]])
print(myMatrix)
print(type(myMatrix))

myMatrix = ghpythonremote.obtain(myMatrix.tolist())
myMatrix = list_to_tree(myMatrix, source=[0,0])
# ---------- end ghpython_script_10 ----------
ghpython_script_11 = GhPythonScript()  # -> out, myMatrix
# ---------- ghpython_script_11: Python ----------
__author__ = "Sculpture"
__version__ = "2022.06.02"

import rhinoscriptsyntax as rs
import scriptcontext as sc
import ghpythonremote
from ghpythonlib.treehelpers import list_to_tree #rhino 6,7 only!
np = sc.sticky['numpy']
rpy = sc.sticky['rpy']

a = np.array([[1,2,3], [4,5,6], [7,8,9]])
b = np.array([[1,2,3], [4,5,6], [7,8,9]])
print(a + b)

myMatrix = (a + b)
myMatrix = ghpythonremote.obtain(myMatrix.tolist())
myMatrix = list_to_tree(myMatrix, source=[0,0])
# ---------- end ghpython_script_11 ----------
ghpython_script_12 = GhPythonScript(x=Slider(2, range=0..10), y=Slider(2, range=0..10), z=Slider(2, range=0..10))  # -> out, changeIt; inputs x: Int32, y: Int32, z: Int32
# ---------- ghpython_script_12: Python ----------
import rhinoscriptsyntax as rs
import scriptcontext as sc
import ghpythonremote
from ghpythonlib.treehelpers import list_to_tree #rhino 6,7 only!
np = sc.sticky['numpy']
rpy = sc.sticky['rpy']

changeIt = np.array([1,2,3,4,5,6,7,8])
print(changeIt)

if x*y*z == len(changeIt):
    changeIt = changeIt.reshape(2,2,2)
    print(changeIt)
    changeIt = ghpythonremote.obtain(changeIt.tolist())
    changeIt = list_to_tree(changeIt, source=[0,0])
    
else:
    print("error")
# ---------- end ghpython_script_12 ----------
ghpython_script_13 = GhPythonScript(x=Slider(2, range=0..10), y=Slider(2, range=0..10), z=Slider(2, range=0..10))  # -> out, changeIt; inputs x: Int32, y: Int32, z: Int32
# ---------- ghpython_script_13: Python ----------
import rhinoscriptsyntax as rs
import scriptcontext as sc
import ghpythonremote
from ghpythonlib.treehelpers import list_to_tree #rhino 6,7 only!
np = sc.sticky['numpy']
rpy = sc.sticky['rpy']

changeIt = np.array([[1,2,3,4],[5,6,7,8]])
print(changeIt)

changeIt = np.transpose(changeIt)

#Grasshopper list and tree
changeIt = ghpythonremote.obtain(changeIt.tolist())
changeIt = list_to_tree(changeIt, source=[0,0])
print(changeIt)
# ---------- end ghpython_script_13 ----------
ghpython_script_14 = GhPythonScript()  # -> out, a, b, c
# ---------- ghpython_script_14: Python ----------
import rhinoscriptsyntax as rs
import scriptcontext as sc
import ghpythonremote
from ghpythonlib.treehelpers import list_to_tree #rhino 6,7 only!
np = sc.sticky['numpy']
rpy = sc.sticky['rpy']

print(np.identity(5))

a = np.array([[1,2],[3,4]])
b = np.linalg.inv(a)

c = np.allclose(np.dot(a,b), np.identity(2))
print(np.allclose(np.dot(a,b), np.identity(2)))

#Grasshopper list and tree
a = ghpythonremote.obtain(a.tolist())
print(a)
print type(a)
a = list_to_tree(a, source=[0,0])
print type(a)

b = ghpythonremote.obtain(b.tolist())
print(b)
print type(b)
b= list_to_tree(b, source=[0,0])
print type(b)
# ---------- end ghpython_script_14 ----------
panel_19 = Panel(ghpython_script_10.out)
panel_20 = Panel(ghpython_script_11.out)
panel_21 = Panel(ghpython_script_9.out)
panel_22 = Panel(ghpython_script_12.out)
panel_23 = Panel(ghpython_script_12.changeIt)
panel_24 = Panel(ghpython_script_14.out)
panel_25 = Panel(ghpython_script_13.out)
panel_26 = Panel(ghpython_script_13.changeIt)
panel_27 = Panel(ghpython_script_14.a)
panel_28 = Panel(ghpython_script_14.c)
panel_29 = Panel(ghpython_script_11.myMatrix)
panel_30 = Panel(ghpython_script_9.myMatrix)
panel_31 = Panel(ghpython_script_14.b)
panel_32 = Panel(ghpython_script_10.myMatrix)
ghpython_script_15 = GhPythonScript(count=Slider(4, range=0..10))  # -> out, randOut; inputs count: Int32
# ---------- ghpython_script_15: Python ----------
import rhinoscriptsyntax as rs
import scriptcontext as sc
import ghpythonremote
import random
from ghpythonlib.treehelpers import list_to_tree #rhino 6,7 only!
np = sc.sticky['numpy']
rpy = sc.sticky['rpy']

from itertools import combinations
import random

a = np.array([1,2,3,4])

pool = []

for comb in combinations(a,2):
    print(comb)
    pool.append(comb)

print(randOut)
randOut = (random.sample(pool, count))
# ---------- end ghpython_script_15 ----------
ghpython_script_16 = GhPythonScript(x=Slider(4, range=0..10), y=Slider(7, range=0..10), z=Slider(10, range=0..10))  # -> out, a_list; inputs x: Int32, y: Int32, z: Int32
# ---------- ghpython_script_16: Python ----------
__author__ = "Sculpture"
__version__ = "2022.06.02"

import rhinoscriptsyntax as rs
import scriptcontext as sc
import ghpythonremote
from ghpythonlib.treehelpers import list_to_tree #rhino 6,7 only!
np = sc.sticky['numpy']
rpy = sc.sticky['rpy']

from itertools import permutations

a = np.array([x,y,z])

newList = []
a_list = []

for i in range(len(a)):
    newList.append(i)
    
#print newList

for p in permutations(a):
    print(p)
    a_list.append(p)
    #for j in newList:
        #print(p[j])

print(a_list)
print(type(a_list))
# ---------- end ghpython_script_16 ----------
ghpython_script_17 = GhPythonScript()  # -> out, a_list
# ---------- ghpython_script_17: Python ----------
import rhinoscriptsyntax as rs
import scriptcontext as sc
import ghpythonremote
import random
from ghpythonlib.treehelpers import list_to_tree #rhino 6,7 only!
np = sc.sticky['numpy']
rpy = sc.sticky['rpy']

from itertools import combinations

a = np.array([1,2,3,4])

a_list = []

for comb in combinations(a,2):
    print(comb)
    a_list.append(comb)

print(a_list)
print(type(a_list))
# ---------- end ghpython_script_17 ----------
ghpython_script_18 = GhPythonScript()  # -> out, b
# ---------- ghpython_script_18: Python ----------
import rhinoscriptsyntax as rs
import scriptcontext as sc
import ghpythonremote
import random
from ghpythonlib.treehelpers import list_to_tree #rhino 6,7 only!
np = sc.sticky['numpy']
rpy = sc.sticky['rpy']
from itertools import combinations
import random

a = np.array([1,2,3,4,4,5,4,3,2,1,4,6,7,4])

b = np.array(list(set(a)))

print(b)
b = ghpythonremote.obtain(b.tolist())
b = list_to_tree(b, source=[0,0])
# ---------- end ghpython_script_18 ----------
panel_33 = Panel(ghpython_script_15.out)
panel_34 = Panel(ghpython_script_17.out)
panel_35 = Panel(ghpython_script_17.a_list)
panel_36 = Panel(ghpython_script_16.out)
panel_37 = Panel(ghpython_script_15.randOut)
panel_38 = Panel(ghpython_script_16.a_list)
panel_39 = Panel(ghpython_script_18.out)
panel_40 = Panel(ghpython_script_18.b)
number_slider = Slider(4, range=0..10)
factorial = Factorial(Number=number_slider)
ghpython_script_19 = GhPythonScript(n=number_slider)  # -> out, a; inputs n: Int32
# ---------- ghpython_script_19: Python ----------
__author__ = "Sculpture"
__version__ = "2022.06.02"

import rhinoscriptsyntax as rs

def factorial(n):
    print('factorial called with n = ' + str(n))
    if n == 1 or n == 0:
        print('Ending condition met. ')
        return 1
    else:
        return n * factorial(n-1)
        
print(factorial(n))

#a = factorial(n)
# ---------- end ghpython_script_19 ----------
ghpython_script_20 = GhPythonScript(n=Slider(6, range=0..10))  # -> out, a; inputs n: Int32
# ---------- ghpython_script_20: Python ----------
__author__ = "Sculpture"
__version__ = "2022.06.02"

import rhinoscriptsyntax as rs

def factorial(n):
    print("factorial called with n = " + str(n))
    if n > 1:
        return n * factorial(n-1)
    print("Ending condition met.")
    return 1


print(factorial(n))
# ---------- end ghpython_script_20 ----------
ghpython_script_21 = GhPythonScript(n=Slider(6, range=0..10))  # -> out, a; inputs n: Int32
# ---------- ghpython_script_21: Python ----------
__author__ = "Sculpture"
__version__ = "2022.06.02"

import rhinoscriptsyntax as rs

def factorial(n):
    print("factorial called with n = " + str(n))
    result = 1
    while n > 1:
        result = result * n
        n = n - 1
        print("Current value of n is " + str(n))
    print("Ending condition met.")
    return result


print(factorial(n))
# ---------- end ghpython_script_21 ----------
panel_41 = Panel(ghpython_script_19.out)
panel_42 = Panel(ghpython_script_20.out)
panel_43 = Panel(ghpython_script_21.out)
panel_44 = Panel(factorial)
number_slider_2 = Slider(5, range=0..10)
ghpython_script_22 = GhPythonScript(count=Slider(100, range=0..100), num=Slider(49, range=0..100))  # -> out, count, num; inputs count: Int32, num: Int32
# ---------- ghpython_script_22: Python ----------
__author__ = "Sculpture"
__version__ = "2022.06.04"

import rhinoscriptsyntax as rs


def search(searchList, key):
    mid = int(len(searchList)/2)
    print("Searching midpoint at " + str(searchList[mid]))
    
    
    if mid == 0:
        print("Key Not Found!")
        return key
    
    elif key == searchList[mid]:
        print("Key Found!")
        return searchList[mid]
        
    elif key >= searchList[mid]:
        print("searchList now contains "+ str(searchList[mid:len(searchList)]))
        search(searchList[mid:len(searchList)], key)
        
    else:
        print("searchList now contains "+ str(searchList[0:mid]))
        search(searchList[0:mid], key)

aList = list(range(1, count))
search(aList, num)
# ---------- end ghpython_script_22 ----------
# ALGORITHMS for Dummies TRANSLATED IN TO GRASSHOPPER FOR RHINO3D, Chapter 5: Developing a Matrix Computation Class
# NumPy ranks in the top ten Python libraries.
# 
# There are reasons not to use numpy and to create your own class to perform at least the basic matrix manipulation tasks.
# 
# This will help you understand what's involved in creating such a class.
# 
# You may need to know how to flatten your matrix for certain types of calculations.
# 
# Source code is available online, however it will need to be fit to the grasshopper ghpython component to work in Rhino3D.
# Avoiding the Use of NumPy
# 
# Updates may charge your application to fail.
# 
# Coplexity at 486 page user guide.
# 
# Changes are difficult to make.
# 
# NumPOy requires C/C++ in addition to Python.
# rely on C++ arrays, rather than Pythons doubly linked lists.
# 
# Difficult
# 
# NumPy uses values that Python doesn't understand.  i.e. NAN
# 
# Using a contiguous range of memory slows things down.
panel_45 = Panel(ghpython_script_22.out)
panel_46 = Panel(ghpython_script_22.count)
# Understanding Why Using a Class is Important
# 
# Object-Oriented Programming (OOP)
# 1. Encapsulation
# 2. Inheritance
# 3. Polymorphism
# 
# Here are the reasons to use a class to hold your matrix routines:
# 1. Organization
# 2. Ease to access
# 3. Esier development
# 4. Collision elimination
# 5. Cohesiveless
panel_47 = Panel(ghpython_script_22.num)

# ----
# Building the Basic Class
number_slider_3 = Slider(100, range=0..100)
number_slider_4 = Slider(5, range=0..10)
ghpython_script_23 = GhPythonScript(count=number_slider_3, num=Slider(49, range=0..100))  # -> out, count, num; inputs count: Int32, num: Int32; same code as ghpython_script_22
panel_48 = Panel(ghpython_script_23.out)
panel_49 = Panel(ghpython_script_23.count)
panel_50 = Panel(ghpython_script_23.num)

# ==== cluster GHPythonRemote: Connects the Grasshopper Python component to an external Python instance.
python = PythonScript()  # -> gh_parent_doc_dir
# ---------- python: Python ----------
from os import path

gh_parent_doc_dir = path.abspath(path.dirname(ghenv.Component.OnPingDocument().Owner.OnPingDocument().FilePath))
# ---------- end python ----------
# GH to python remote example.
# Pierre Cuvilliers, 2017-2018
# Released under the MIT license
# github.com/pilcru/ghpythonremote
# Runs and connects to an external python engine, and
# assigns imported modules to scriptcontext.sticky variables.
# 
# Arguments:
#       code (str): Path to the GH_to_python_sticky.py code file.
#       location (str): Path to a python executable, or to a folder
#             containing `python.exe`, or the name of a conda-created
#             virtual environment prefixed by `conda://` (`conda://env_name`).
#             If empty, finds python from your windows %PATH%.
#       run (boolean): Creates the connection, and imports new
#             modules, when turned to True. Kills the connection,
#             and deletes the references to the imports, when turned
#             to False.
#       modules (str list): List of module names to import in the
#             remote python. They will be added to the
#             scriptcontext.sticky dictionary, allowing them to be
#             reused from other python components in the same
#             Grasshopper document. Submodules (for example
#             `numpy.linalg` have to be added explicitly to this list
#             to be available later.
#       log_level (str from ['NOTSET', 'DEBUG', 'INFO', 'WARNING', 'ERROR', 'CRITICAL']):
#             Logging level to use for the local IronPython and the
#             remote python instance.
#       working_dir (str): Working directory for the remote python
#             instance.
# 
# Returns:
#       out (str): Console output with DEBUG information.
#       linked_modules (str list): list of imported module names.
#       rpy (rpyc connection object): The object representing the
#             remote Python interpreter.
location = ClusterInput()  # location (str): Path to a python executable, or to a folder containing `python.exe`, or the name of a conda-created virtual environment prefixed by `conda://` (`conda://env_name`). If empty, finds python from your windows %PATH%.
run = ClusterInput()  # run (boolean): Creates the connection, and imports new modules, when turned to True. Kills the connection,and deletes the references to the imports, when turned to False.
modules = ClusterInput()  # modules (str list): List of module names to import in the remote python. They will be added to the scriptcontext.sticky dictionary, allowing them to be reused from other python components in the same Grasshopper document. Submodules (for example `numpy.linalg` have to be added explicitly to this list to be available later.
list = ValueList({"CRITICAL", "ERROR", "WARNING", "INFO", "DEBUG", "NOTSET"}, selected="DEBUG")
panel = Panel(python)
ghpythonremote = GHPythonRemote(location=location, run=run, modules=modules, log_level=list, working_dir=panel)  # -> out, linked_modules, rpy; inputs run: Boolean, modules: list
# ---------- ghpythonremote: Python ----------
import inspect
import logging
from os import path
import sys
from time import sleep

import scriptcontext

import ghpythonremote
from ghpythonremote.connectors import GrasshopperToPythonRemote

local_log_level = getattr(logging, log_level, logging.WARNING)
logger = logging.getLogger("ghpythonremote")
logger.setLevel(local_log_level)
ch = logging.StreamHandler()
ch.setLevel(local_log_level)
formatter = logging.Formatter("%(levelname)s: %(name)s:\n%(message)s")
ch.setFormatter(formatter)
logger.handlers = []
logger.addHandler(ch)
logger = logging.getLogger("ghpythonremote.GH_to_python")

ROOT = path.abspath(path.dirname(inspect.getfile(ghpythonremote)))
rpyc_server_py = path.join(ROOT, "pythonservice.py")

# Set connection to CLOSED if this is the first run
# and initialize set of linked modules
try:
    remote_python_status
except NameError:
    remote_python_status = "CLOSED"
    lkd_modules = set()

# Wait for connection to connect or terminate
timer = 0
while remote_python_status == "CONNECTING" or remote_python_status == "CLOSING":
    sleep(1)
    timer += 1
    if timer == 10:
        try:
            gh2py_manager.__exit__(*sys.exc_info())
        except Exception:
            pass
        remote_python_status = "CLOSED"
        lkd_modules = set()
        raise RuntimeError(
            "Connection left in an inconsistent state and not returning. Reset "
            "everything."
        )

if run:
    if not remote_python_status == "OPEN":
        remote_python_status = "CONNECTING"
        gh2py_manager = GrasshopperToPythonRemote(
            rpyc_server_py,
            location=location,
            timeout=10,
            port=None,
            log_level=log_level,
            working_dir=working_dir,
        )
        gh2py = gh2py_manager.__enter__()
        remote_python_status = "OPEN"

    # Stuff that we can reach
    rpymod = gh2py.py_remote_modules  # A getter function for a named python module
    rpy = gh2py.connection  # Represents the remote instance root object
    scriptcontext.sticky["rpy"] = rpy
    # Add modules
    for mod in modules:
        try:
            scriptcontext.sticky[mod] = rpymod(mod)
            lkd_modules.add(mod)
        except ImportError:
            gh2py_manager.__exit__(*sys.exc_info())
            raise

elif not remote_python_status == "CLOSED":
    remote_python_status = "CLOSING"
    # Remove linked modules
    for mod in lkd_modules:
        del scriptcontext.sticky[mod]
    del scriptcontext.sticky["rpy"]
    gh2py_manager.__exit__(*sys.exc_info())
    lkd_modules = set()
    remote_python_status = "CLOSED"

# Change variable name because ghpython resets outputs to None before each run
linked_modules = lkd_modules

logger.info("GH to python connection is {}".format(remote_python_status))
# ---------- end ghpythonremote ----------
out = ClusterOutput(ghpythonremote.out)  # Console output.
linked_modules = ClusterOutput(ghpythonremote.linked_modules)  # Names of modules that were successfully added to the scriptcontext.sticky dictionary.
rpy = ClusterOutput(ghpythonremote.rpy)  # The object representing the remote python instance
python_2 = PythonScript(module_names=ghpythonremote.linked_modules)  # -> import_statements; inputs module_names: list
# ---------- python_2: Python ----------
import_statements = ["import scriptcontext as sc"]
for module_name in module_names:
    import_statements.append("{0} = sc.sticky['{0}']".format(module_name))

if len(module_names) == 0:
    import_statements = []
# ---------- end python_2 ----------
import_statements = ClusterOutput(python_2)  # Useful import statements to use the imported modules in your scripts.
