# Grasshopper definition ghPython_Algorithms4Dummies_Chapter_5.gh (Grasshopper 1.0.7)
# Copyright: © 2017-2018 Pierre Cuvilliers, Caitlin Mueller, Massachusetts Institute of Technology

number_slider = Slider(5, range=0..10)
number_slider_2 = Slider(2, range=0..10)
# Understanding Why Using a Class is Important
# 
# Object-Oriented Programming (OOP)
# 1. Encapsulation
# 2. Inheritance
# 3. Polymorphism
# 
# Here are the reasons to use a class to hold your matrix routines:
# 1. Organization
# 2. Ease to access
# 3. Esier development
# 4. Collision elimination
# 5. Cohesiveless
# Building the Basic Class
# 
# The Matrix class is written with simplicity in mind.
# 
# It doesn't include type checking code, matrix size or error trapping.
# 
# Creating a matrix
# 
# 
# 
# The Matrix constructor allows the creation of blank matrixes of a certain size,
# or matrixes that already have values initialized using a Python list.
# When creating a blank matrix,
# the code fills the values with None so that it's easy to check for initialization.
# 
# Two-dimensional matrix is a good foundation.
# 
# i.e. class Matrix:
# 
# Even though NumPy doesn't provide a direct
# method of specifying the matrix shape during
# the initialization, it does provide the reshape()
# function to do after initialization.
# 
# The Matrix class provides a fixed size.
# 
# There is no best way to accomplish tasks.
number_slider_3 = Slider(3, range=0..10)
# ALGORITHMS for Dummies TRANSLATED IN TO GRASSHOPPER FOR RHINO3D, Chapter 5: Developing a Matrix Computation Class
# NumPy ranks in the top ten Python libraries.
# 
# There are reasons not to use numpy and to create your own class to perform at least the basic matrix manipulation tasks.
# 
# This will help you understand what's involved in creating such a class.
# 
# You may need to know how to flatten your matrix for certain types of calculations.
# 
# Source code is available online, however it will need to be fit to the grasshopper ghpython component to work in Rhino3D.
# Avoiding the Use of NumPy
# 
# Updates may charge your application to fail.
# 
# Coplexity at 486 page user guide.
# 
# Changes are difficult to make.
# 
# NumPOy requires C/C++ in addition to Python.
# rely on C++ arrays, rather than Pythons doubly linked lists.
# 
# Difficult
# 
# NumPy uses values that Python doesn't understand.  i.e. NAN
# 
# Using a contiguous range of memory slows things down.
panel = Panel("numpy")
matrix_class = GhPythonScript(numRows=number_slider_3, numColumns=Slider(2, range=0..10))  # -> out, c; inputs numRows: Int32, numColumns: Int32
# ---------- matrix_class: Python ----------
__author__ = "Sculpture"
__version__ = "2022.06.04"

import rhinoscriptsyntax as rs
import scriptcontext as sc
import ghpythonremote
# Grasshopper does not recognize remote list objects as list:
from ghpythonlib.treehelpers import list_to_tree #rhino 6,7 only!
np = sc.sticky['numpy']
rpy = sc.sticky['rpy']


class Matrix:
    rows = 0
    columns = 0
    matrix = []
    matrixRow = []
    dataCount = 0
    matrixList = []
    tempProduct = 0
    
    
    def __init__(self, Rows, Columns, Data = []):
        if Data == []:
            Data = [None] * (Rows * Columns)
        self.matrix = []
        self.rows = Rows
        self.columns = Columns
        for i in range(Rows):
            self.matrixRow = []
            for j in range(Columns):
                self.matrixRow.append(Data[self.dataCount])
                self.dataCount += 1
            self.matrix.append(self.matrixRow)


myMatrix = Matrix(numRows, numColumns)
print(myMatrix.rows)
print(myMatrix.columns)
print(myMatrix.matrix)
print(type(myMatrix.matrix))

c= (myMatrix.matrix)
c = list_to_tree(c, source=[0,0])
# ---------- end matrix_class ----------
matrix_class_2 = GhPythonScript(numRows=number_slider, numColumns=number_slider_2)  # -> out, nullMatrix, customMatrix; inputs numRows: Int32, numColumns: Int32
# ---------- matrix_class_2: Python ----------
__author__ = "Sculpture"
__version__ = "2022.06.04"

import rhinoscriptsyntax as rs
import scriptcontext as sc
import ghpythonremote
# Grasshopper does not recognize remote list objects as list:
from ghpythonlib.treehelpers import list_to_tree #rhino 6,7 only!
np = sc.sticky['numpy']
rpy = sc.sticky['rpy']


class Matrix:
    rows = 0
    columns = 0
    matrix = []
    matrixRow = []
    dataCount = 0
    matrixList = []
    tempProduct = 0
    
    
    def __init__(self, Rows, Columns, Data = []):
        if Data == []:
            Data = [None] * (Rows * Columns)
        self.matrix = []
        self.rows = Rows
        self.columns = Columns
        for i in range(Rows):
            self.matrixRow = []
            for j in range(Columns):
                self.matrixRow.append(Data[self.dataCount])
                self.dataCount += 1
            self.matrix.append(self.matrixRow)


myMatrix = Matrix(numRows, numColumns)
print(myMatrix.rows)
print(myMatrix.columns)
print(myMatrix.matrix)
print(type(myMatrix.matrix))

# null matrix
nullMatrix = (myMatrix.matrix)
nullMatrix = list_to_tree(nullMatrix, source=[0,0])

#custom matrix
z = list(range(numRows * numColumns))
print(z)
myMatrix2 = Matrix(numRows, numColumns, z)
print(myMatrix2.matrix)

customMatrix = (myMatrix2.matrix)
customMatrix = list_to_tree(customMatrix, source=[0,0])
# ---------- end matrix_class_2 ----------
matrix_class_3 = GhPythonScript(numRows=number_slider, numColumns=number_slider_2)  # -> out, nullMatrix, customMatrix; inputs numRows: Int32, numColumns: Int32; same code as matrix_class_2
gh_python_remote = GHPythonRemote(location="C:\Users\Sculpture\anaconda3\envs\rhinoremote", run=Toggle(True), modules=panel)  # -> out, linked_modules, rpy, import_statements
ghpython_script = GhPythonScript()  # -> Out, A
panel_2 = Panel(matrix_class.out)
panel_3 = Panel(matrix_class.c)
panel_4 = Panel(matrix_class_2.nullMatrix)
panel_5 = Panel(matrix_class_2.out)
panel_6 = Panel(gh_python_remote.import_statements)
panel_7 = Panel(matrix_class_2.customMatrix)
# Performing scalar and matrix addition
number_slider_4 = Slider(3, range=0..10)
matrix_class_4 = GhPythonScript(
    numRows=number_slider_4,
    numColumns=Slider(3, range=0..10),
    row=Slider(2, range=0..10),
    column=Slider(1, range=0..10),
    addNum=Slider(10, range=0..10))  # -> out, nullMatrix, customMatrix, matrixElements1, matrixElements2, addNumOut; inputs numRows: Int32, numColumns: Int32, row: Int32, column: Int32
# ---------- matrix_class_4: Python ----------
__author__ = "Sculpture"
__version__ = "2022.06.04"

import rhinoscriptsyntax as rs
import scriptcontext as sc
import ghpythonremote
# Grasshopper does not recognize remote list objects as list:
from ghpythonlib.treehelpers import list_to_tree #rhino 6,7 only!
np = sc.sticky['numpy']
rpy = sc.sticky['rpy']


class Matrix:
    rows = 0
    columns = 0
    matrix = []
    matrixRow = []
    dataCount = 0
    matrixList = []
    tempProduct = 0
    
    
    def __init__(self, Rows, Columns, Data = []):
        if Data == []:
            Data = [None] * (Rows * Columns)
        self.matrix = []
        self.rows = Rows
        self.columns = Columns
        for i in range(Rows):
            self.matrixRow = []
            for j in range(Columns):
                self.matrixRow.append(Data[self.dataCount])
                self.dataCount += 1
            self.matrix.append(self.matrixRow)
    
    
    #Accessing specific matrix elements
    def __getitem__(self, index):
        return self.matrix[index]
    
    
    # use the __add__ method
    def __add__(self, Value):
        self.matrixList = []
        if type(Value) == list:
            for i in range(self.rows):
                for j in range(self.columns):
                    self.matrixList.append(self.matrix[i][j] + Value[i][j])
        else:
            for i in range(self.rows):
                for j in range(self.columns):
                    self.matrixList.append(self.matrix[i][j] + Value)
        return Matrix(self.rows, self.columns, self.matrixList)



myMatrix = Matrix(numRows, numColumns)
print(myMatrix.rows)
print(myMatrix.columns)
print(myMatrix.matrix)
print(type(myMatrix.matrix))

# null matrix
nullMatrix = (myMatrix.matrix)
nullMatrix = list_to_tree(nullMatrix, source=[0,0])

#custom matrix
z = list(range(numRows * numColumns))
print(z)
myMatrix2 = Matrix(numRows, numColumns, z)
print(myMatrix2.matrix)

customMatrix = (myMatrix2.matrix)
customMatrix = list_to_tree(customMatrix, source=[0,0])

#Accessing specific matrix elements
print(myMatrix2[1])
print(myMatrix2[1][2])

if (row < numRows) and (column < numColumns):
    matrixElements1 = (myMatrix2[row])
    matrixElements2 = (myMatrix2[row][column])
else:
    print("index out of range")

myMatrix2 += addNum
print(myMatrix2.matrix)
addNumOut = (myMatrix2.matrix)
print type(myMatrix2.matrix)
addNumOut = list_to_tree(addNumOut, source=[0,0])

if (numRows and numColumns) == 3:
    myMatrix2 += [[2,4,6],[8,10,12],[20, 30, 40]]
else:
    print("index out of range")
print(myMatrix2.matrix)
print type(myMatrix2.matrix)
# ---------- end matrix_class_4 ----------
panel_8 = Panel(matrix_class_4.out)
panel_9 = Panel(matrix_class_4.nullMatrix)
panel_10 = Panel(matrix_class_4.addNumOut)
panel_11 = Panel(matrix_class_4.customMatrix)
panel_12 = Panel(matrix_class_4.matrixElements1)
panel_13 = Panel(matrix_class_4.matrixElements2)
# Performing multiplication
# 1. Element-wise product
# 2. Dot product
number_slider_5 = Slider(3, range=0..10)
# Performing multiplication
# 1. Element-wise product
# 2. Dot product
number_slider_6 = Slider(3, range=0..10)
matrix_class_5 = GhPythonScript(
    numRows=number_slider_5,
    numColumns=Slider(3, range=0..10),
    row=Slider(2, range=0..10),
    column=Slider(1, range=0..10),
    addNum=Slider(10, range=0..10))  # -> out, nullMatrix, customMatrix, matrixElements1, matrixElements2, addNumOut, a, b, p, s; inputs numRows: Int32, numColumns: Int32, row: Int32, column: Int32
# ---------- matrix_class_5: Python ----------
__author__ = "Sculpture"
__version__ = "2022.06.04"

import rhinoscriptsyntax as rs
import scriptcontext as sc
import ghpythonremote
# Grasshopper does not recognize remote list objects as list:
from ghpythonlib.treehelpers import list_to_tree #rhino 6,7 only!
np = sc.sticky['numpy']
rpy = sc.sticky['rpy']

#algorithm

class Matrix:
    rows = 0
    columns = 0
    matrix = []
    matrixRow = []
    dataCount = 0
    matrixList = []
    tempProduct = 0
    
    
    def __init__(self, Rows, Columns, Data = []):
        if Data == []:
            Data = [None] * (Rows * Columns)
        self.matrix = []
        self.rows = Rows
        self.columns = Columns
        for i in range(Rows):
            self.matrixRow = []
            for j in range(Columns):
                self.matrixRow.append(Data[self.dataCount])
                self.dataCount += 1
            self.matrix.append(self.matrixRow)
    
    
    #Accessing specific matrix elements
    def __getitem__(self, index):
        return self.matrix[index]
    
    
    # use the __add__ method
    def __add__(self, Value):
        self.matrixList = []
        if type(Value) == list:
            for i in range(self.rows):
                for j in range(self.columns):
                    self.matrixList.append(self.matrix[i][j] + Value[i][j])
        else:
            for i in range(self.rows):
                for j in range(self.columns):
                    self.matrixList.append(self.matrix[i][j] + Value)
        return Matrix(self.rows, self.columns, self.matrixList)
    
    
    #Performing multiplication
    #Element-wise product and dot product
    #i.e. hours and total wage example
    #__mul__ function
    def _mul__(self, MatrixIn):
        self.matrixList = []
        for i in range(self.rows):
            for j in range(self.columns):
                self.matrixList.append(self.matrix[i][j] * MatrixIn[i][j])
        return Matrix(self.rows, self.columns, self.matrixList)
    #Matrixes must be the same size when using the inner product
    
    
    #Performing multiplication with dot product
    #hardcoded
    def dot(self, MatrixIn):
        self.matrixList = []
        for i in range(self.rows):
            for j in range(MatrixIn.columns):
                tempProduct = 0
                for k in range(self.columns):
                    tempProduct += self.matrix[i][k] * matrixIn[k][j]
                self.matrixList.append(tempProduct)
        return Matrix(self.rows, MatrixIn.columns, self.matrixList)
#Output

myMatrix = Matrix(numRows, numColumns)
print(myMatrix.rows)
print(myMatrix.columns)
print(myMatrix.matrix)
print(type(myMatrix.matrix))

# null matrix
nullMatrix = (myMatrix.matrix)
nullMatrix = list_to_tree(nullMatrix, source=[0,0])

#custom matrix
z = list(range(numRows * numColumns))
print(z)
myMatrix2 = Matrix(numRows, numColumns, z)
print(myMatrix2.matrix)

customMatrix = (myMatrix2.matrix)
customMatrix = list_to_tree(customMatrix, source=[0,0])

#Accessing specific matrix elements
print(myMatrix2[1])
print(myMatrix2[1][2])

if (row < numRows) and (column < numColumns):
    matrixElements1 = (myMatrix2[row])
    matrixElements2 = (myMatrix2[row][column])
else:
    print("index out of range")

#scalar and matrix addition
myMatrix2 += addNum
print(myMatrix2.matrix)
addNumOut = (myMatrix2.matrix)
print type(myMatrix2.matrix)
addNumOut = list_to_tree(addNumOut, source=[0,0])

if (numRows and numColumns) == 3:
    myMatrix2 += [[2,4,6],[8,10,12],[20, 30, 40]]
else:
    print("index out of range")
print(myMatrix2.matrix)
print type(myMatrix2.matrix)

#Performing multiplication with element-wise product
#hardcoded
A = Matrix(2,3,[1,2,3,4,5,6])
B = Matrix(2,3,[1,2,3,4,5,6])
print(A.matrix)
print type(A.matrix)
a = A.matrix
a = list_to_tree(a, source=[0,0])
print(B.matrix)
print type(B.matrix)
b = B.matrix
b = list_to_tree(b, source=[0,0])
#Matrix type is not supported in ghpython
#print((A*B).matrix)
#continue with gh math component multiplication after list_to_tree

#Performing multiplication with dot product
#hardcoded
Price = Matrix(5,3,[1,2,1,1,3,2,2,2,1,2,3,2,1,2,2])
Sales = Matrix(3,5,[5,3,4,3,2,2,3,3,4,4,1,2,4,2,3])
print(Price.matrix)
print type(Price.matrix)
p = Price.matrix
p = list_to_tree(p, source=[0,0])
print(Sales.matrix)
print type(Sales.matrix)
s = Sales.matrix
s = list_to_tree(s, source=[0,0])
#print(Price.dot(Sales).matrix)
#Matrix type is not supported in ghpython
#print(Price.dot(Sales).matrix)
#continue with gh components after list_to_tree
# ---------- end matrix_class_5 ----------
matrix_class_6 = GhPythonScript(
    numRows=number_slider_6,
    numColumns=Slider(3, range=0..10),
    row=Slider(2, range=0..10),
    column=Slider(1, range=0..10),
    addNum=Slider(10, range=0..10))  # -> out, nullMatrix, customMatrix, matrixElements1, matrixElements2, addNumOut, a, b; inputs numRows: Int32, numColumns: Int32, row: Int32, column: Int32
# ---------- matrix_class_6: Python ----------
__author__ = "Sculpture"
__version__ = "2022.06.04"

import rhinoscriptsyntax as rs
import scriptcontext as sc
import ghpythonremote
# Grasshopper does not recognize remote list objects as list:
from ghpythonlib.treehelpers import list_to_tree #rhino 6,7 only!
np = sc.sticky['numpy']
rpy = sc.sticky['rpy']

#algorithm

class Matrix:
    rows = 0
    columns = 0
    matrix = []
    matrixRow = []
    dataCount = 0
    matrixList = []
    tempProduct = 0
    
    
    def __init__(self, Rows, Columns, Data = []):
        if Data == []:
            Data = [None] * (Rows * Columns)
        self.matrix = []
        self.rows = Rows
        self.columns = Columns
        for i in range(Rows):
            self.matrixRow = []
            for j in range(Columns):
                self.matrixRow.append(Data[self.dataCount])
                self.dataCount += 1
            self.matrix.append(self.matrixRow)
    
    
    #Accessing specific matrix elements
    def __getitem__(self, index):
        return self.matrix[index]
    
    
    # use the __add__ method
    def __add__(self, Value):
        self.matrixList = []
        if type(Value) == list:
            for i in range(self.rows):
                for j in range(self.columns):
                    self.matrixList.append(self.matrix[i][j] + Value[i][j])
        else:
            for i in range(self.rows):
                for j in range(self.columns):
                    self.matrixList.append(self.matrix[i][j] + Value)
        return Matrix(self.rows, self.columns, self.matrixList)
    
    
    #Performing multiplication
    #Element-wise product and dot product
    #i.e. hours and total wage example
    #__mul__ function
    def _mul__(self, MatrixIn):
        self.matrixList = []
        for i in range(self.rows):
            for j in range(self.columns):
                self.matrixList.append(self.matrix[i][j] * MatrixIn[i][j])
        return Matrix(self.rows, self.columns, self.matrixList)
        
    #Matrixes must be the same size when using the inner product
    
    

#Output

myMatrix = Matrix(numRows, numColumns)
print(myMatrix.rows)
print(myMatrix.columns)
print(myMatrix.matrix)
print(type(myMatrix.matrix))

# null matrix
nullMatrix = (myMatrix.matrix)
nullMatrix = list_to_tree(nullMatrix, source=[0,0])

#custom matrix
z = list(range(numRows * numColumns))
print(z)
myMatrix2 = Matrix(numRows, numColumns, z)
print(myMatrix2.matrix)

customMatrix = (myMatrix2.matrix)
customMatrix = list_to_tree(customMatrix, source=[0,0])

#Accessing specific matrix elements
print(myMatrix2[1])
print(myMatrix2[1][2])

if (row < numRows) and (column < numColumns):
    matrixElements1 = (myMatrix2[row])
    matrixElements2 = (myMatrix2[row][column])
else:
    print("index out of range")

#scalar and matrix addition
myMatrix2 += addNum
print(myMatrix2.matrix)
addNumOut = (myMatrix2.matrix)
print type(myMatrix2.matrix)
addNumOut = list_to_tree(addNumOut, source=[0,0])

if (numRows and numColumns) == 3:
    myMatrix2 += [[2,4,6],[8,10,12],[20, 30, 40]]
else:
    print("index out of range")
print(myMatrix2.matrix)
print type(myMatrix2.matrix)

#Performing multiplication with element-wise product
#hardcoded
#Performing multiplication with element-wise product
A = Matrix(2,3,[1,2,3,4,5,6])
B = Matrix(2,3,[1,2,3,4,5,6])
print(A.matrix)
print type(A.matrix)
a = A.matrix
a = list_to_tree(a, source=[0,0])
print(B.matrix)
print type(B.matrix)
b = B.matrix
b = list_to_tree(b, source=[0,0])

#Matrix type is not supported in ghpython
#print((A*B).matrix)
#continue with gh math component multiplication after list_to_tree
# ---------- end matrix_class_6 ----------
panel_14 = Panel(matrix_class_5.nullMatrix)
panel_15 = Panel(matrix_class_5.a)
panel_16 = Panel(matrix_class_5.out)
panel_17 = Panel(matrix_class_5.p)
panel_18 = Panel(matrix_class_6.nullMatrix)
panel_19 = Panel(matrix_class_6.a)
panel_20 = Panel(matrix_class_6.out)
panel_21 = Panel(matrix_class_5.b)
panel_22 = Panel(matrix_class_5.s)
panel_23 = Panel(matrix_class_6.b)
panel_24 = Panel(matrix_class_5.customMatrix)
panel_25 = Panel(matrix_class_6.customMatrix)
multiplication = Multiplication(A=panel_19, B=panel_23)
list_item = ListItem(List=panel_17, Index=0, Wrap=True)  # -> Item, Item1, Item2
multiplication_2 = Multiplication(A=panel_15, B=panel_21)
list_item_2 = ListItem(List=panel_22, Index=0, Wrap=True)  # -> Item, Item1, Item2, Item3, Item4
panel_26 = Panel(matrix_class_5.matrixElements1)
panel_27 = Panel(matrix_class_6.matrixElements1)
panel_28 = Panel(multiplication)
panel_29 = Panel(multiplication_2)
panel_30 = Panel(matrix_class_5.matrixElements2)
panel_31 = Panel(matrix_class_6.matrixElements2)
panel_32 = Panel(list_item_2.Item2)
panel_33 = Panel(list_item_2.Item)
panel_34 = Panel(list_item_2.Item1)
panel_35 = Panel(list_item_2.Item3)
panel_36 = Panel(list_item_2.Item4)
vector_xyz = VectorXYZ(XComponent=list_item.Item, YComponent=list_item.Item1, ZComponent=list_item.Item2)  # -> Vector, Length
list_item_3 = ListItem(List=flatten(panel_33), Index=0, Wrap=True)  # -> Item, Item1, Item2
list_item_4 = ListItem(List=flatten(panel_34), Index=0, Wrap=True)  # -> Item, Item1, Item2
list_item_5 = ListItem(List=flatten(panel_32), Index=0, Wrap=True)  # -> Item, Item1, Item2
list_item_6 = ListItem(List=flatten(panel_35), Index=0, Wrap=True)  # -> Item, Item1, Item2
list_item_7 = ListItem(List=flatten(panel_36), Index=0, Wrap=True)  # -> Item, Item1, Item2
panel_37 = Panel(matrix_class_5.addNumOut)
panel_38 = Panel(matrix_class_6.addNumOut)
vector_xyz_2 = VectorXYZ(XComponent=list_item_3.Item, YComponent=list_item_3.Item1, ZComponent=list_item_3.Item2)  # -> Vector, Length
vector_xyz_3 = VectorXYZ(XComponent=list_item_7.Item, YComponent=list_item_7.Item1, ZComponent=list_item_7.Item2)  # -> Vector, Length
vector_xyz_4 = VectorXYZ(XComponent=list_item_4.Item, YComponent=list_item_4.Item1, ZComponent=list_item_4.Item2)  # -> Vector, Length
vector_xyz_5 = VectorXYZ(XComponent=list_item_5.Item, YComponent=list_item_5.Item1, ZComponent=list_item_5.Item2)  # -> Vector, Length
vector_xyz_6 = VectorXYZ(XComponent=list_item_6.Item, YComponent=list_item_6.Item1, ZComponent=list_item_6.Item2)  # -> Vector, Length
dot_product = DotProduct(VectorA=vector_xyz.Vector, VectorB=vector_xyz_2.Vector, Unitize=False)
dot_product_2 = DotProduct(VectorA=vector_xyz.Vector, VectorB=vector_xyz_4.Vector, Unitize=False)
dot_product_3 = DotProduct(VectorA=vector_xyz.Vector, VectorB=vector_xyz_5.Vector, Unitize=False)
dot_product_4 = DotProduct(VectorA=vector_xyz.Vector, VectorB=vector_xyz_6.Vector, Unitize=False)
dot_product_5 = DotProduct(VectorA=vector_xyz.Vector, VectorB=vector_xyz_3.Vector, Unitize=False)
vector_display = VectorDisplay(Anchor=vector_xyz_3.Vector, Vector=vector_xyz_3.Vector)
vector_display_2 = VectorDisplay(Anchor=vector_xyz_5.Vector, Vector=vector_xyz_5.Vector)
vector_display_3 = VectorDisplay(Anchor=vector_xyz_6.Vector, Vector=vector_xyz_6.Vector)
vector_display_4 = VectorDisplay(Anchor=vector_xyz_2.Vector, Vector=vector_xyz_2.Vector)
vector_display_5 = VectorDisplay(Anchor=vector_xyz_4.Vector, Vector=vector_xyz_4.Vector)
panel_39 = Panel([dot_product, dot_product_2, dot_product_3, dot_product_4, dot_product_5])
merge = Merge(Data1=dot_product, Data2=dot_product_2, Data3=dot_product_3, Data4=dot_product_4, Data5=dot_product_5)  # -> flatten(Result)
# Flattening the matrix
panel_40 = Panel(merge)
# Manipulating the Matrix
# 1. Transposing a matrix
# 2. Calculating the determinant
number_slider_7 = Slider(3, range=0..10)

# ----
# Flattening the matrix
number_slider_8 = Slider(3, range=0..10)
# Manipulating the Matrix
# 1. Transposing a matrix
# 2. Calculating the determinant
matrix_class_7 = GhPythonScript(
    numRows=Slider(3, range=0..10),
    numColumns=number_slider_8,
    row=Slider(2, range=0..10),
    column=Slider(1, range=0..10),
    addNum=Slider(10, range=0..10))  # -> out, nullMatrix, customMatrix, matrixElements1, matrixElements2, addNumOut, a, b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; inputs numRows: Int32, numColumns: Int32, row: Int32, column: Int32
# ---------- matrix_class_7: Python ----------
__author__ = "Sculpture"
__version__ = "2022.06.04"

import rhinoscriptsyntax as rs
import scriptcontext as sc
import ghpythonremote
# Grasshopper does not recognize remote list objects as list:
from ghpythonlib.treehelpers import list_to_tree #rhino 6,7 only!
np = sc.sticky['numpy']
rpy = sc.sticky['rpy']

#algorithm

class Matrix:
    rows = 0
    columns = 0
    matrix = []
    matrixRow = []
    dataCount = 0
    matrixList = []
    tempProduct = 0
    
    
    def __init__(self, Rows, Columns, Data = []):
        if Data == []:
            Data = [None] * (Rows * Columns)
        self.matrix = []
        self.rows = Rows
        self.columns = Columns
        for i in range(Rows):
            self.matrixRow = []
            for j in range(Columns):
                self.matrixRow.append(Data[self.dataCount])
                self.dataCount += 1
            self.matrix.append(self.matrixRow)
    
    
    #Accessing specific matrix elements
    def __getitem__(self, index):
        return self.matrix[index]
    
    
    # use the __add__ method
    def __add__(self, Value):
        self.matrixList = []
        if type(Value) == list:
            for i in range(self.rows):
                for j in range(self.columns):
                    self.matrixList.append(self.matrix[i][j] + Value[i][j])
        else:
            for i in range(self.rows):
                for j in range(self.columns):
                    self.matrixList.append(self.matrix[i][j] + Value)
        return Matrix(self.rows, self.columns, self.matrixList)
    
    
    #Performing multiplication
    #Element-wise product and dot product
    #i.e. hours and total wage example
    #__mul__ function
    def _mul__(self, MatrixIn):
        self.matrixList = []
        for i in range(self.rows):
            for j in range(self.columns):
                self.matrixList.append(self.matrix[i][j] * MatrixIn[i][j])
        return Matrix(self.rows, self.columns, self.matrixList)
    #Matrixes must be the same size when using the inner product
    
    
    #Performing multiplication with dot product
    #hardcoded
    def dot(self, MatrixIn):
        self.matrixList = []
        for i in range(self.rows):
            for j in range(MatrixIn.columns):
                tempProduct = 0
                for k in range(self.columns):
                    tempProduct += self.matrix[i][k] * matrixIn[k][j]
                self.matrixList.append(tempProduct)
        return Matrix(self.rows, MatrixIn.columns, self.matrixList)
    
    
    #Transpose matrix
    def transpose(self):
        self.matrixList = []
        for i in range(self.columns):
            for j in range(self.rows):
                self.matrixList.append(self.matrix[j][i])
        return Matrix(self.columns, self.rows, self.matrixList)
    
    
    #Calculating the detrerminant
    # this only applies to square matices
    # This can calculate the inverse matrix, a matrix that produces the identiy matrix when * by a matrix
    # many ways: the Laplace expansion, recusion and easy to understand
    # The Matrix Reshish website calculates the determinant of a matrix
    #The Symponab calculator
    
    #Creating some prerequisite code
    #copyMatrix() code create a copy with in new memory
    #Performing the calculation on 2x2 and 3x3 matrixes, uses recursion
    #nice code
    def determinant(self, Result=0):
        #address the simplest case first, the 2 x 2 matrix
        if len(self.matrix) == 2:
            twoOut = self.matrix[0][0] * self.matrix[1][1] - self.matrix[1][0] * self.matrix[0][1]
            return twoOut
    
        #Determine the number of rows in a matrix larger than 2 x 2
        rows = list(range(len(self.matrix)))
    
        #Process each focus column in turn for focus in rows:
            
        #Create a copy of the matrix.
        submatrix.matrix = submatrix.matrix()
            
        #Remove the first row of the submatrix
        submatrix.matrix = submatrix.matrix[1:]
            
        #Obtain the number of remaining rows to process.
        subrows = len(submatrix.matrix)
            
        #Create the next smaller size matrix by slicing out the focus rows.
        for i in range(subrows):
            submatrix.matrix[i][0:focus] + submatrix.matrix[i][focus+1:]
            
        #Determine the sign to use when performing the multiplication.
        sign = (-1) **(focus % 2)
            
        #Call the determinant() function recursively with each smaller matrix.
        subdeterminant = submatrix.determinant()
            
        #Total the returns form the recursive calls.
        Result += sign.matrix[0][focus] * subdeterminant
        
        return Result
            
    
    #Flattening the matrix
    def flatten(self):
        self.matrixList = []
        for i in range(self.rows):
            for j in range(self.columns):
                self.matrixList.append(self.matrix[i][j])
        nestedResult = Matrix(1, self.rows * self.columns, self.matrixList)
        nestedResult.matrix = nestedResult.matrix[0]
        return nestedResult
        
    
#Output

myMatrix = Matrix(numRows, numColumns)
print(myMatrix.rows)
print(myMatrix.columns)
print(myMatrix.matrix)
print(type(myMatrix.matrix))

# null matrix
nullMatrix = (myMatrix.matrix)
nullMatrix = list_to_tree(nullMatrix, source=[0,0])

#custom matrix
z = list(range(numRows * numColumns))
print(z)
myMatrix2 = Matrix(numRows, numColumns, z)
print(myMatrix2.matrix)

customMatrix = (myMatrix2.matrix)
customMatrix = list_to_tree(customMatrix, source=[0,0])

#Accessing specific matrix elements
print(myMatrix2[1])
print(myMatrix2[1][2])

if (row < numRows) and (column < numColumns):
    matrixElements1 = (myMatrix2[row])
    matrixElements2 = (myMatrix2[row][column])
else:
    print("index out of range")

#scalar and matrix addition
myMatrix2 += addNum
print(myMatrix2.matrix)
addNumOut = (myMatrix2.matrix)
print type(myMatrix2.matrix)
addNumOut = list_to_tree(addNumOut, source=[0,0])

if (numRows and numColumns) == 3:
    myMatrix2 += [[2,4,6],[8,10,12],[20, 30, 40]]
else:
    print("index out of range")
print(myMatrix2.matrix)
print type(myMatrix2.matrix)

#Performing multiplication with element-wise product
#hardcoded
A = Matrix(2,3,[1,2,3,4,5,6])
B = Matrix(2,3,[1,2,3,4,5,6])
print(A.matrix)
print type(A.matrix)
a = A.matrix
a = list_to_tree(a, source=[0,0])
print(B.matrix)
print type(B.matrix)
b = B.matrix
b = list_to_tree(b, source=[0,0])
#Matrix type is not supported in ghpython
#print((A*B).matrix)
#continue with gh math component multiplication after list_to_tree

#Performing multiplication with dot product
#hardcoded
Price = Matrix(5,3,[1,2,1,1,3,2,2,2,1,2,3,2,1,2,2])
Sales = Matrix(3,5,[5,3,4,3,2,2,3,3,4,4,1,2,4,2,3])
print(Price.matrix)
print type(Price.matrix)
p = Price.matrix
p = list_to_tree(p, source=[0,0])
print(Sales.matrix)
print type(Sales.matrix)
s = Sales.matrix
s = list_to_tree(s, source=[0,0])
#print(Price.dot(Sales).matrix)
#Matrix type is not supported in ghpython
#print(Price.dot(Sales).matrix)
#continue with gh components after list_to_tree

#Transposing a matrix
print(A.matrix)
print type(A.matrix)
print(A.transpose().matrix)
t = (A.transpose().matrix)
t = list_to_tree(t, source=[0,0])

#Determinant
C = Matrix(2,2,[1,2,3,4])
print(C.matrix)
print type(C.matrix)
d = C.matrix
d = list_to_tree(d, source=[0,0])
#Matrix type is not supported in ghpython
#print(C.determinant().matrix)
#continue with gh components after list_to_tree

#Flattening the matrix
print(A.matrix)
print(A.flatten().matrix)
f = (A.flatten().matrix)
f = list_to_tree(f, source=[0,0])
# ---------- end matrix_class_7 ----------
panel_41 = Panel(matrix_class_7.nullMatrix)
panel_42 = Panel(matrix_class_7.a)
panel_43 = Panel(matrix_class_7.p)
panel_44 = Panel(matrix_class_7.out)
panel_45 = Panel(matrix_class_7.b)
panel_46 = Panel(matrix_class_7.s)
panel_47 = Panel(matrix_class_7.customMatrix)
list_item_8 = ListItem(List=panel_43, Index=0, Wrap=True)  # -> Item, Item1, Item2
multiplication_3 = Multiplication(A=panel_42, B=panel_45)
list_item_9 = ListItem(List=panel_46, Index=0, Wrap=True)  # -> Item, Item1, Item2, Item3, Item4
panel_48 = Panel(matrix_class_7.matrixElements1)
panel_49 = Panel(multiplication_3)
panel_50 = Panel(matrix_class_7.matrixElements2)
panel_51 = Panel(list_item_9.Item2)
panel_52 = Panel(list_item_9.Item)
panel_53 = Panel(list_item_9.Item3)
panel_54 = Panel(list_item_9.Item1)
panel_55 = Panel(list_item_9.Item4)
vector_xyz_7 = VectorXYZ(XComponent=list_item_8.Item, YComponent=list_item_8.Item1, ZComponent=list_item_8.Item2)  # -> Vector, Length
list_item_10 = ListItem(List=flatten(panel_52), Index=0, Wrap=True)  # -> Item, Item1, Item2
list_item_11 = ListItem(List=flatten(panel_54), Index=0, Wrap=True)  # -> Item, Item1, Item2
list_item_12 = ListItem(List=flatten(panel_51), Index=0, Wrap=True)  # -> Item, Item1, Item2
list_item_13 = ListItem(List=flatten(panel_53), Index=0, Wrap=True)  # -> Item, Item1, Item2
list_item_14 = ListItem(List=flatten(panel_55), Index=0, Wrap=True)  # -> Item, Item1, Item2
panel_56 = Panel(matrix_class_7.addNumOut)
vector_xyz_8 = VectorXYZ(XComponent=list_item_10.Item, YComponent=list_item_10.Item1, ZComponent=list_item_10.Item2)  # -> Vector, Length
vector_xyz_9 = VectorXYZ(XComponent=list_item_14.Item, YComponent=list_item_14.Item1, ZComponent=list_item_14.Item2)  # -> Vector, Length
vector_xyz_10 = VectorXYZ(XComponent=list_item_11.Item, YComponent=list_item_11.Item1, ZComponent=list_item_11.Item2)  # -> Vector, Length
vector_xyz_11 = VectorXYZ(XComponent=list_item_12.Item, YComponent=list_item_12.Item1, ZComponent=list_item_12.Item2)  # -> Vector, Length
vector_xyz_12 = VectorXYZ(XComponent=list_item_13.Item, YComponent=list_item_13.Item1, ZComponent=list_item_13.Item2)  # -> Vector, Length
dot_product_6 = DotProduct(VectorA=vector_xyz_7.Vector, VectorB=vector_xyz_8.Vector, Unitize=False)
dot_product_7 = DotProduct(VectorA=vector_xyz_7.Vector, VectorB=vector_xyz_10.Vector, Unitize=False)
dot_product_8 = DotProduct(VectorA=vector_xyz_7.Vector, VectorB=vector_xyz_11.Vector, Unitize=False)
dot_product_9 = DotProduct(VectorA=vector_xyz_7.Vector, VectorB=vector_xyz_12.Vector, Unitize=False)
dot_product_10 = DotProduct(VectorA=vector_xyz_7.Vector, VectorB=vector_xyz_9.Vector, Unitize=False)
vector_display_6 = VectorDisplay(Anchor=vector_xyz_9.Vector, Vector=vector_xyz_9.Vector)
vector_display_7 = VectorDisplay(Anchor=vector_xyz_11.Vector, Vector=vector_xyz_11.Vector)
vector_display_8 = VectorDisplay(Anchor=vector_xyz_12.Vector, Vector=vector_xyz_12.Vector)
vector_display_9 = VectorDisplay(Anchor=vector_xyz_8.Vector, Vector=vector_xyz_8.Vector)
vector_display_10 = VectorDisplay(Anchor=vector_xyz_10.Vector, Vector=vector_xyz_10.Vector)
panel_57 = Panel([dot_product_6, dot_product_7, dot_product_8, dot_product_9, dot_product_10])
panel_58 = Panel(matrix_class_7.t)
panel_59 = Panel(matrix_class_7.d)
panel_60 = Panel(matrix_class_7.f)
merge_2 = Merge(Data1=dot_product_6, Data2=dot_product_7, Data3=dot_product_8, Data4=dot_product_9, Data5=dot_product_10)  # -> flatten(Result)
panel_61 = Panel(merge_2)

matrix_class_8 = GhPythonScript(
    numRows=number_slider_7,
    numColumns=Slider(3, range=0..10),
    row=Slider(2, range=0..10),
    column=Slider(1, range=0..10),
    addNum=Slider(10, range=0..10))  # -> out, nullMatrix, customMatrix, matrixElements1, matrixElements2, addNumOut, a, b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; inputs numRows: Int32, numColumns: Int32, row: Int32, column: Int32
# ---------- matrix_class_8: Python ----------
__author__ = "Sculpture"
__version__ = "2022.06.04"

import rhinoscriptsyntax as rs
import scriptcontext as sc
import ghpythonremote
# Grasshopper does not recognize remote list objects as list:
from ghpythonlib.treehelpers import list_to_tree #rhino 6,7 only!
np = sc.sticky['numpy']
rpy = sc.sticky['rpy']

#algorithm

class Matrix:
    rows = 0
    columns = 0
    matrix = []
    matrixRow = []
    dataCount = 0
    matrixList = []
    tempProduct = 0
    
    
    def __init__(self, Rows, Columns, Data = []):
        if Data == []:
            Data = [None] * (Rows * Columns)
        self.matrix = []
        self.rows = Rows
        self.columns = Columns
        for i in range(Rows):
            self.matrixRow = []
            for j in range(Columns):
                self.matrixRow.append(Data[self.dataCount])
                self.dataCount += 1
            self.matrix.append(self.matrixRow)
    
    
    #Accessing specific matrix elements
    def __getitem__(self, index):
        return self.matrix[index]
    
    
    # use the __add__ method
    def __add__(self, Value):
        self.matrixList = []
        if type(Value) == list:
            for i in range(self.rows):
                for j in range(self.columns):
                    self.matrixList.append(self.matrix[i][j] + Value[i][j])
        else:
            for i in range(self.rows):
                for j in range(self.columns):
                    self.matrixList.append(self.matrix[i][j] + Value)
        return Matrix(self.rows, self.columns, self.matrixList)
    
    
    #Performing multiplication
    #Element-wise product and dot product
    #i.e. hours and total wage example
    #__mul__ function
    def _mul__(self, MatrixIn):
        self.matrixList = []
        for i in range(self.rows):
            for j in range(self.columns):
                self.matrixList.append(self.matrix[i][j] * MatrixIn[i][j])
        return Matrix(self.rows, self.columns, self.matrixList)
    #Matrixes must be the same size when using the inner product
    
    
    #Performing multiplication with dot product
    #hardcoded
    def dot(self, MatrixIn):
        self.matrixList = []
        for i in range(self.rows):
            for j in range(MatrixIn.columns):
                tempProduct = 0
                for k in range(self.columns):
                    tempProduct += self.matrix[i][k] * matrixIn[k][j]
                self.matrixList.append(tempProduct)
        return Matrix(self.rows, MatrixIn.columns, self.matrixList)
    
    
    def transpose(self):
        self.matrixList = []
        for i in range(self.columns):
            for j in range(self.rows):
                self.matrixList.append(self.matrix[j][i])
        return Matrix(self.columns, self.rows, self.matrixList)
    
    
    
    
#Output

myMatrix = Matrix(numRows, numColumns)
print(myMatrix.rows)
print(myMatrix.columns)
print(myMatrix.matrix)
print(type(myMatrix.matrix))

# null matrix
nullMatrix = (myMatrix.matrix)
nullMatrix = list_to_tree(nullMatrix, source=[0,0])

#custom matrix
z = list(range(numRows * numColumns))
print(z)
myMatrix2 = Matrix(numRows, numColumns, z)
print(myMatrix2.matrix)

customMatrix = (myMatrix2.matrix)
customMatrix = list_to_tree(customMatrix, source=[0,0])

#Accessing specific matrix elements
print(myMatrix2[1])
print(myMatrix2[1][2])

if (row < numRows) and (column < numColumns):
    matrixElements1 = (myMatrix2[row])
    matrixElements2 = (myMatrix2[row][column])
else:
    print("index out of range")

#scalar and matrix addition
myMatrix2 += addNum
print(myMatrix2.matrix)
addNumOut = (myMatrix2.matrix)
print type(myMatrix2.matrix)
addNumOut = list_to_tree(addNumOut, source=[0,0])

if (numRows and numColumns) == 3:
    myMatrix2 += [[2,4,6],[8,10,12],[20, 30, 40]]
else:
    print("index out of range")
print(myMatrix2.matrix)
print type(myMatrix2.matrix)

#Performing multiplication with element-wise product
#hardcoded
A = Matrix(2,3,[1,2,3,4,5,6])
B = Matrix(2,3,[1,2,3,4,5,6])
print(A.matrix)
print type(A.matrix)
a = A.matrix
a = list_to_tree(a, source=[0,0])
print(B.matrix)
print type(B.matrix)
b = B.matrix
b = list_to_tree(b, source=[0,0])
#Matrix type is not supported in ghpython
#print((A*B).matrix)
#continue with gh math component multiplication after list_to_tree

#Performing multiplication with dot product
#hardcoded
Price = Matrix(5,3,[1,2,1,1,3,2,2,2,1,2,3,2,1,2,2])
Sales = Matrix(3,5,[5,3,4,3,2,2,3,3,4,4,1,2,4,2,3])
print(Price.matrix)
print type(Price.matrix)
p = Price.matrix
p = list_to_tree(p, source=[0,0])
print(Sales.matrix)
print type(Sales.matrix)
s = Sales.matrix
s = list_to_tree(s, source=[0,0])
#print(Price.dot(Sales).matrix)
#Matrix type is not supported in ghpython
#print(Price.dot(Sales).matrix)
#continue with gh components after list_to_tree

#Transposing a matrix
print(A.matrix)
print type(A.matrix)
print(A.transpose().matrix)
t = (A.transpose().matrix)
t = list_to_tree(t, source=[0,0])
# ---------- end matrix_class_8 ----------
panel_62 = Panel(matrix_class_8.t)
panel_63 = Panel(matrix_class_8.nullMatrix)
panel_64 = Panel(matrix_class_8.a)
panel_65 = Panel(matrix_class_8.out)
panel_66 = Panel(matrix_class_8.p)
panel_67 = Panel(matrix_class_8.b)
panel_68 = Panel(matrix_class_8.s)
panel_69 = Panel(matrix_class_8.customMatrix)
list_item_15 = ListItem(List=panel_66, Index=0, Wrap=True)  # -> Item, Item1, Item2
multiplication_4 = Multiplication(A=panel_64, B=panel_67)
list_item_16 = ListItem(List=panel_68, Index=0, Wrap=True)  # -> Item, Item1, Item2, Item3, Item4
panel_70 = Panel(matrix_class_8.matrixElements1)
panel_71 = Panel(multiplication_4)
panel_72 = Panel(matrix_class_8.matrixElements2)
panel_73 = Panel(list_item_16.Item2)
panel_74 = Panel(list_item_16.Item)
panel_75 = Panel(list_item_16.Item1)
panel_76 = Panel(list_item_16.Item3)
panel_77 = Panel(list_item_16.Item4)
vector_xyz_13 = VectorXYZ(XComponent=list_item_15.Item, YComponent=list_item_15.Item1, ZComponent=list_item_15.Item2)  # -> Vector, Length
list_item_17 = ListItem(List=flatten(panel_74), Index=0, Wrap=True)  # -> Item, Item1, Item2
list_item_18 = ListItem(List=flatten(panel_75), Index=0, Wrap=True)  # -> Item, Item1, Item2
list_item_19 = ListItem(List=flatten(panel_73), Index=0, Wrap=True)  # -> Item, Item1, Item2
list_item_20 = ListItem(List=flatten(panel_76), Index=0, Wrap=True)  # -> Item, Item1, Item2
list_item_21 = ListItem(List=flatten(panel_77), Index=0, Wrap=True)  # -> Item, Item1, Item2
panel_78 = Panel(matrix_class_8.addNumOut)
vector_xyz_14 = VectorXYZ(XComponent=list_item_17.Item, YComponent=list_item_17.Item1, ZComponent=list_item_17.Item2)  # -> Vector, Length
vector_xyz_15 = VectorXYZ(XComponent=list_item_21.Item, YComponent=list_item_21.Item1, ZComponent=list_item_21.Item2)  # -> Vector, Length
vector_xyz_16 = VectorXYZ(XComponent=list_item_18.Item, YComponent=list_item_18.Item1, ZComponent=list_item_18.Item2)  # -> Vector, Length
vector_xyz_17 = VectorXYZ(XComponent=list_item_19.Item, YComponent=list_item_19.Item1, ZComponent=list_item_19.Item2)  # -> Vector, Length
vector_xyz_18 = VectorXYZ(XComponent=list_item_20.Item, YComponent=list_item_20.Item1, ZComponent=list_item_20.Item2)  # -> Vector, Length
dot_product_11 = DotProduct(VectorA=vector_xyz_13.Vector, VectorB=vector_xyz_14.Vector, Unitize=False)
dot_product_12 = DotProduct(VectorA=vector_xyz_13.Vector, VectorB=vector_xyz_16.Vector, Unitize=False)
dot_product_13 = DotProduct(VectorA=vector_xyz_13.Vector, VectorB=vector_xyz_17.Vector, Unitize=False)
dot_product_14 = DotProduct(VectorA=vector_xyz_13.Vector, VectorB=vector_xyz_18.Vector, Unitize=False)
dot_product_15 = DotProduct(VectorA=vector_xyz_13.Vector, VectorB=vector_xyz_15.Vector, Unitize=False)
vector_display_11 = VectorDisplay(Anchor=vector_xyz_15.Vector, Vector=vector_xyz_15.Vector)
vector_display_12 = VectorDisplay(Anchor=vector_xyz_17.Vector, Vector=vector_xyz_17.Vector)
vector_display_13 = VectorDisplay(Anchor=vector_xyz_18.Vector, Vector=vector_xyz_18.Vector)
vector_display_14 = VectorDisplay(Anchor=vector_xyz_14.Vector, Vector=vector_xyz_14.Vector)
vector_display_15 = VectorDisplay(Anchor=vector_xyz_16.Vector, Vector=vector_xyz_16.Vector)
panel_79 = Panel([dot_product_11, dot_product_12, dot_product_13, dot_product_14, dot_product_15])
merge_3 = Merge(Data1=dot_product_11, Data2=dot_product_12, Data3=dot_product_13, Data4=dot_product_14, Data5=dot_product_15)  # -> flatten(Result)
# Flattening the matrix
panel_80 = Panel(merge_3)

# ==== cluster GHPythonRemote: Connects the Grasshopper Python component to an external Python instance.
python = PythonScript()  # -> gh_parent_doc_dir
# ---------- python: Python ----------
from os import path

gh_parent_doc_dir = path.abspath(path.dirname(ghenv.Component.OnPingDocument().Owner.OnPingDocument().FilePath))
# ---------- end python ----------
# GH to python remote example.
# Pierre Cuvilliers, 2017-2018
# Released under the MIT license
# github.com/pilcru/ghpythonremote
# Runs and connects to an external python engine, and
# assigns imported modules to scriptcontext.sticky variables.
# 
# Arguments:
#       code (str): Path to the GH_to_python_sticky.py code file.
#       location (str): Path to a python executable, or to a folder
#             containing `python.exe`, or the name of a conda-created
#             virtual environment prefixed by `conda://` (`conda://env_name`).
#             If empty, finds python from your windows %PATH%.
#       run (boolean): Creates the connection, and imports new
#             modules, when turned to True. Kills the connection,
#             and deletes the references to the imports, when turned
#             to False.
#       modules (str list): List of module names to import in the
#             remote python. They will be added to the
#             scriptcontext.sticky dictionary, allowing them to be
#             reused from other python components in the same
#             Grasshopper document. Submodules (for example
#             `numpy.linalg` have to be added explicitly to this list
#             to be available later.
#       log_level (str from ['NOTSET', 'DEBUG', 'INFO', 'WARNING', 'ERROR', 'CRITICAL']):
#             Logging level to use for the local IronPython and the
#             remote python instance.
#       working_dir (str): Working directory for the remote python
#             instance.
# 
# Returns:
#       out (str): Console output with DEBUG information.
#       linked_modules (str list): list of imported module names.
#       rpy (rpyc connection object): The object representing the
#             remote Python interpreter.
location = ClusterInput()  # location (str): Path to a python executable, or to a folder containing `python.exe`, or the name of a conda-created virtual environment prefixed by `conda://` (`conda://env_name`). If empty, finds python from your windows %PATH%.
run = ClusterInput()  # run (boolean): Creates the connection, and imports new modules, when turned to True. Kills the connection,and deletes the references to the imports, when turned to False.
modules = ClusterInput()  # modules (str list): List of module names to import in the remote python. They will be added to the scriptcontext.sticky dictionary, allowing them to be reused from other python components in the same Grasshopper document. Submodules (for example `numpy.linalg` have to be added explicitly to this list to be available later.
list = ValueList({"CRITICAL", "ERROR", "WARNING", "INFO", "DEBUG", "NOTSET"}, selected="DEBUG")
panel = Panel(python)
ghpythonremote = GHPythonRemote(location=location, run=run, modules=modules, log_level=list, working_dir=panel)  # -> out, linked_modules, rpy; inputs run: Boolean, modules: list
# ---------- ghpythonremote: Python ----------
import inspect
import logging
from os import path
import sys
from time import sleep

import scriptcontext

import ghpythonremote
from ghpythonremote.connectors import GrasshopperToPythonRemote

local_log_level = getattr(logging, log_level, logging.WARNING)
logger = logging.getLogger("ghpythonremote")
logger.setLevel(local_log_level)
ch = logging.StreamHandler()
ch.setLevel(local_log_level)
formatter = logging.Formatter("%(levelname)s: %(name)s:\n%(message)s")
ch.setFormatter(formatter)
logger.handlers = []
logger.addHandler(ch)
logger = logging.getLogger("ghpythonremote.GH_to_python")

ROOT = path.abspath(path.dirname(inspect.getfile(ghpythonremote)))
rpyc_server_py = path.join(ROOT, "pythonservice.py")

# Set connection to CLOSED if this is the first run
# and initialize set of linked modules
try:
    remote_python_status
except NameError:
    remote_python_status = "CLOSED"
    lkd_modules = set()

# Wait for connection to connect or terminate
timer = 0
while remote_python_status == "CONNECTING" or remote_python_status == "CLOSING":
    sleep(1)
    timer += 1
    if timer == 10:
        try:
            gh2py_manager.__exit__(*sys.exc_info())
        except Exception:
            pass
        remote_python_status = "CLOSED"
        lkd_modules = set()
        raise RuntimeError(
            "Connection left in an inconsistent state and not returning. Reset "
            "everything."
        )

if run:
    if not remote_python_status == "OPEN":
        remote_python_status = "CONNECTING"
        gh2py_manager = GrasshopperToPythonRemote(
            rpyc_server_py,
            location=location,
            timeout=10,
            port=None,
            log_level=log_level,
            working_dir=working_dir,
        )
        gh2py = gh2py_manager.__enter__()
        remote_python_status = "OPEN"

    # Stuff that we can reach
    rpymod = gh2py.py_remote_modules  # A getter function for a named python module
    rpy = gh2py.connection  # Represents the remote instance root object
    scriptcontext.sticky["rpy"] = rpy
    # Add modules
    for mod in modules:
        try:
            scriptcontext.sticky[mod] = rpymod(mod)
            lkd_modules.add(mod)
        except ImportError:
            gh2py_manager.__exit__(*sys.exc_info())
            raise

elif not remote_python_status == "CLOSED":
    remote_python_status = "CLOSING"
    # Remove linked modules
    for mod in lkd_modules:
        del scriptcontext.sticky[mod]
    del scriptcontext.sticky["rpy"]
    gh2py_manager.__exit__(*sys.exc_info())
    lkd_modules = set()
    remote_python_status = "CLOSED"

# Change variable name because ghpython resets outputs to None before each run
linked_modules = lkd_modules

logger.info("GH to python connection is {}".format(remote_python_status))
# ---------- end ghpythonremote ----------
out = ClusterOutput(ghpythonremote.out)  # Console output.
linked_modules = ClusterOutput(ghpythonremote.linked_modules)  # Names of modules that were successfully added to the scriptcontext.sticky dictionary.
rpy = ClusterOutput(ghpythonremote.rpy)  # The object representing the remote python instance
python_2 = PythonScript(module_names=ghpythonremote.linked_modules)  # -> import_statements; inputs module_names: list
# ---------- python_2: Python ----------
import_statements = ["import scriptcontext as sc"]
for module_name in module_names:
    import_statements.append("{0} = sc.sticky['{0}']".format(module_name))

if len(module_names) == 0:
    import_statements = []
# ---------- end python_2 ----------
import_statements = ClusterOutput(python_2)  # Useful import statements to use the imported modules in your scripts.
