# Grasshopper definition ghPython_Algorithms4Dummies_Chapter_5_6.gh (Grasshopper 1.0.7)
# Copyright: © 2017-2018 Pierre Cuvilliers, Caitlin Mueller, Massachusetts Institute of Technology

# ALGORITHMS for Dummies TRANSLATED IN TO GRASSHOPPER FOR RHINO3D, Chapter 6: Structuring Data
# Raw data is just that: raw.
# Needs to be structures and cleaned.
# Stacks, queues and dictionaries
# Trees and Graphs
# Determining the Need for Structure
# All data need the same attributes, appearance and components.
# This relies on have the data in sorted order.
# 
# Making it easier to see the content
# Need to understand the content of the data
# i.e. "1" the string and 1 the integer differ to the computer
# i.e. (913) 912 1234 vs. 013-912-1234 differs as well
# 
# Matching data from various sources
# 1. determine both datasets contain all the required data
# 2. check both datasets for data type issues
# 3. ensure all datasets place the same meaning in data elements
# 4. verify data attributes
# 
# Consider the need for remediation
# time consuming and straightforward
# data duplication and missing data:
# 
# Dealing with data duplication:
# import pandas as pd
matrix_class = GhPythonScript()  # -> out
# ---------- matrix_class: Python ----------
__author__ = "Sculpture"
__version__ = "2022.06.04"

import rhinoscriptsyntax as rs
import scriptcontext as sc
import ghpythonremote
# Grasshopper does not recognize remote list objects as list:
from ghpythonlib.treehelpers import list_to_tree #rhino 6,7 only!
numpy = sc.sticky['numpy']
rpy = sc.sticky['rpy']
scipy = sc.sticky['scipy']
matplotlib = sc.sticky['matplotlib']
matplotlib.pyplot = sc.sticky['matplotlib.pyplot']
numpy.linalg = sc.sticky['numpy.linalg']
pandas = sc.sticky['pandas']

#algorithm


#Outputs
# ---------- end matrix_class ----------
# conda install matplotlib -n rhinoremote
# conda install pandas -n rhinoremote
panel = Panel("""numpy
scipy
numpy.linalg
matplotlib
matplotlib.pyplot
pandas
Queue""")
matrix_class_2 = GhPythonScript()  # -> out
# ---------- matrix_class_2: Python ----------
__author__ = "Sculpture"
__version__ = "2022.06.04"

import rhinoscriptsyntax as rs
import scriptcontext as sc
import ghpythonremote
# Grasshopper does not recognize remote list objects as list:
from ghpythonlib.treehelpers import list_to_tree #rhino 6,7 only!
numpy = sc.sticky['numpy']
pandas = sc.sticky['pandas']
rpy = sc.sticky['rpy']
scipy = sc.sticky['scipy']
matplotlib = sc.sticky['matplotlib']
matplotlib.pyplot = sc.sticky['matplotlib.pyplot']
numpy.linalg = sc.sticky['numpy.linalg']

#algorithms
df = pandas.DataFrame({'A' : [0,0,0,0,0,1,0],'B' : [0,2,3,5,0,2,0], 'C' : [0,3,4,1,0,2,0]})

#Outputs
print(df)

df = df.drop_duplicates()
print(df)
print type(df)
#how to turn a DataFrame back into a tree for gh?
#One Example: https://stackoverflow.com/questions/15110889/convert-list-of-arrays-in-python-to-tree-in-grasshopper
# ---------- end matrix_class_2 ----------
# Understanding other remediation issues
# 
# i.e. users misspell
matrix_class_3 = GhPythonScript()  # -> out
# ---------- matrix_class_3: Python ----------
__author__ = "Sculpture"
__version__ = "2022.06.04"

import rhinoscriptsyntax as rs
import scriptcontext as sc
import ghpythonremote
# Grasshopper does not recognize remote list objects as list:
from ghpythonlib.treehelpers import list_to_tree #rhino 6,7 only!

numpy = sc.sticky['numpy']
pandas = sc.sticky['pandas']
rpy = sc.sticky['rpy']
scipy = sc.sticky['scipy']
matplotlib = sc.sticky['matplotlib']
matplotlib.pyplot = sc.sticky['matplotlib.pyplot']
numpy.linalg = sc.sticky['numpy.linalg']


#algorithm
df = pandas.DataFrame({'A' : [0,0,1,None],'B' : [1,2,3,4], 'C' : [numpy.NAN,3,4,1]})

#Outputs
print(df)

values = pandas.Series(df.mean())
print(values)
#can't set datatype to int in ghpython
#limitations of using grasshopper, hitting a wall with different classes, (Matrix and DataFrames, Series)
print type(values)

df = df.fillna(values)
print(df)
#how to turn a DataFrame back into a tree for gh?
#One Example: https://stackoverflow.com/questions/15110889/convert-list-of-arrays-in-python-to-tree-in-grasshopper
# ---------- end matrix_class_3 ----------
panel_2 = Panel(matrix_class_2)
# Dealing with missing values
# 
# you can set them to a standard value, "0"
panel_3 = Panel(matrix_class_3)
gh_python_remote = GHPythonRemote(location="C:\Users\Sculpture\anaconda3\envs\rhinoremote", run=Toggle(True), modules=panel)  # -> out, linked_modules, rpy, import_statements
ghpython_script = GhPythonScript()  # -> Out, A
panel_4 = Panel(gh_python_remote.import_statements)
panel_5 = Panel(gh_python_remote.out)
# Using queues
# 
# first in/first out (FIFO)
# import queue
matrix_class_4 = GhPythonScript()  # -> out
# ---------- matrix_class_4: Python ----------
__author__ = "Sculpture"
__version__ = "2022.06.04"

import rhinoscriptsyntax as rs
import scriptcontext as sc
import ghpythonremote
# Grasshopper does not recognize remote list objects as list:
from ghpythonlib.treehelpers import list_to_tree #rhino 6,7 only!

numpy = sc.sticky['numpy']
pandas = sc.sticky['pandas']
rpy = sc.sticky['rpy']
scipy = sc.sticky['scipy']
matplotlib = sc.sticky['matplotlib']
matplotlib.pyplot = sc.sticky['matplotlib.pyplot']
numpy.linalg = sc.sticky['numpy.linalg']


#algorithm
MyStack = []
StackSize = 3

def DisplayStack():
    print("Stack currently contains:")
    for Item in MyStack:
        print(Item)


def Push(Value):
    if len(MyStack) < StackSize:
        MyStack.append(Value)
    else:
        print("Stack is full!")


def Pop():
    if len(MyStack) > 0:
        print("Popping: ", MyStack.pop())
    else:
        print("Stack is empty.")


#Outputs
#Test the stack functionality.
Push(1)
Push(2)
Push(3)
DisplayStack()

Push(4)

Pop()
DisplayStack()

Pop()
Pop()
Pop()
# ---------- end matrix_class_4 ----------
# Finding data using dictionaries
# 
# Similar to List but you need to define a key and value pair
# 
# The key must be unique
# The key must be immutable (strings, numbers, tuples but not lists)
# 
# special functions key() and update()
# 
# This is a data structure called a Hash Table, an array that maps keys to values
# The values can be any Python object
matrix_class_5 = GhPythonScript()  # -> out
# ---------- matrix_class_5: Python ----------
__author__ = "Sculpture"
__version__ = "2022.06.04"

import rhinoscriptsyntax as rs
import scriptcontext as sc
import ghpythonremote
# Grasshopper does not recognize remote list objects as list:
from ghpythonlib.treehelpers import list_to_tree #rhino 6,7 only!

numpy = sc.sticky['numpy']
pandas = sc.sticky['pandas']
rpy = sc.sticky['rpy']
scipy = sc.sticky['scipy']
matplotlib = sc.sticky['matplotlib']
matplotlib.pyplot = sc.sticky['matplotlib.pyplot']
numpy.linalg = sc.sticky['numpy.linalg']
Queue = sc.sticky['Queue']

#algorithm
MyQueue = Queue.Queue(3)

#Outputs
print"Queue empty: ", MyQueue.empty()
print type(MyQueue)

MyQueue.put(1)
MyQueue.put(2)
MyQueue.put(3)
print"Queue full: ", MyQueue.full()

print"Popping: ", MyQueue.get()
print"Queue full: ", MyQueue.full()

print"Popping: ", MyQueue.get()
print"Popping: ", MyQueue.get()
print"Queue empty : ", MyQueue.empty()

#Queue requires a lot less code than Stack
# ---------- end matrix_class_5 ----------
matrix_class_6 = GhPythonScript()  # -> out
# ---------- matrix_class_6: Python ----------
__author__ = "Sculpture"
__version__ = "2022.06.04"

import rhinoscriptsyntax as rs
import scriptcontext as sc
import ghpythonremote
# Grasshopper does not recognize remote list objects as list:
from ghpythonlib.treehelpers import list_to_tree #rhino 6,7 only!

numpy = sc.sticky['numpy']
pandas = sc.sticky['pandas']
rpy = sc.sticky['rpy']
scipy = sc.sticky['scipy']
matplotlib = sc.sticky['matplotlib']
matplotlib.pyplot = sc.sticky['matplotlib.pyplot']
numpy.linalg = sc.sticky['numpy.linalg']
Queue = sc.sticky['Queue']

#algorithm
Colors = {"Sam": "Blue", "Amy": "Red", "Sarah": "Yellow"}

#Outputs
print(Colors["Sarah"])
print(Colors.keys())

for Item in Colors.keys():
    print("{0} likes the color {1}.".format(Item, Colors[Item]))
    
Colors["Sarah"] = "Purple"
Colors.update({"Harry": "Orange"})
del Colors["Sam"]

print(Colors)
# ---------- end matrix_class_6 ----------
# Stacking and Piling Data in Order
# 
# Ordering in stacks
# Last in/first out (LIFO)
# i.e. Implementing with Python List to see how it works
panel_6 = Panel(matrix_class_4)
panel_7 = Panel(matrix_class_5)
panel_8 = Panel(matrix_class_6)
matrix_class_7 = GhPythonScript()  # -> out, BranchA, LeafC, tree
# ---------- matrix_class_7: Python ----------
__author__ = "Sculpture"
__version__ = "2022.06.04"

import rhinoscriptsyntax as rs
import scriptcontext as sc
import ghpythonremote
# Grasshopper does not recognize remote list objects as list:
from ghpythonlib.treehelpers import list_to_tree #rhino 6,7 only!

numpy = sc.sticky['numpy']
pandas = sc.sticky['pandas']
rpy = sc.sticky['rpy']
scipy = sc.sticky['scipy']
matplotlib = sc.sticky['matplotlib']
matplotlib.pyplot = sc.sticky['matplotlib.pyplot']
numpy.linalg = sc.sticky['numpy.linalg']
Queue = sc.sticky['Queue']

#algorithm
class binaryTree:
    def __init__(self, nodeData, left=None, right=None):
        self.nodeData = nodeData
        self.left = left
        self.right = right
    
    
    def __str__(self):
        return str(self.nodeData)


tree = binaryTree("Root")
BranchA = binaryTree("Branch A")
BranchB = binaryTree("Branch B")
tree.left = BranchA
tree.right = BranchB

LeafC = binaryTree("Leaf C")
LeafD = binaryTree("Leaf D")
LeafE = binaryTree("Leaf E")
LeafF = binaryTree("Leaf F")
BranchA.left = LeafC
BranchA.right = LeafD
BranchB.left = LeafE
BranchB.right = LeafF

#use recursion to traverse the tree to see if tree actually works
def traverse(tree):
    if tree.left != None:
        traverse(tree.left)
    if tree.right != None:
        traverse(tree.right)
    print(tree.nodeData)

traverse(tree)

#Outputs
# ---------- end matrix_class_7 ----------
# Working with Trees
# 
# very much like the physical object in the real world
# 
# used for searches and sort routines
# 
# Understanding the basics of trees
# 
# Each item added to a tree is a Node
# Nodes connect to each other using links
# 
# A tree has just one root node
# 
# Branches and Leaves connect to this root node
# 
# Leaves are always the ending points
# 
# Branches support leaves and other branches tracing back to the root node
# 
# binary trees have at most, two connections
# 
# Building a tree
# 
# Python doesn't come with a built-in tree object
# 
# You are required to create a class to hold the tree data object
# 
# i.e. Tree class
panel_9 = Panel(matrix_class_7.out)
# There are three kinds of data storage structures
# 
# 1. Balanced trees
# 2. Unbalanced trees
# 3. Heaps, make sorting faster
# 
# i.e. Dijkstra and Huffman encoding algorithms
panel_10 = Panel([matrix_class_7.BranchA, matrix_class_7.LeafC, matrix_class_7.tree])
# Representing Relations in a Graph
# 
# Going beyond trees
#  A graph is a sort of tree extension
# 
# They can have more than one connection.
# 
# they can connect to each other in a myriad of ways between nodes.
# 
# Directionality, not parent/child relationship only
# 
# Building graphs
# 
# most developers use dictionaries or lists to build graphs
matrix_class_8 = GhPythonScript()  # -> out
# ---------- matrix_class_8: Python ----------
__author__ = "Sculpture"
__version__ = "2022.06.04"

import rhinoscriptsyntax as rs
import scriptcontext as sc
import ghpythonremote
# Grasshopper does not recognize remote list objects as list:
from ghpythonlib.treehelpers import list_to_tree #rhino 6,7 only!

numpy = sc.sticky['numpy']
pandas = sc.sticky['pandas']
rpy = sc.sticky['rpy']
scipy = sc.sticky['scipy']
matplotlib = sc.sticky['matplotlib']
matplotlib.pyplot = sc.sticky['matplotlib.pyplot']
numpy.linalg = sc.sticky['numpy.linalg']
Queue = sc.sticky['Queue']

#algorithm
graph = {'A': ['B', 'F'],
'B': ['A', 'C'],
'C': ['B', 'D'],
'D': ['C', 'E'],
'E': ['D', 'F'],
'F': ['E', 'A']}

def find_path(graph, start, end, path=[]):
    path = path + [start]
    
    if start == end:
        print("Ending")
        return path
    
    for node in graph[start]:
        print"Checking Node ", node
    
    if node not in path:
        print"Path so far ", path
        
        newp = find_path(graph, node, end, path)
        if newp:
            return newp

find_path(graph, 'B', 'E')
#find_path(graph, 'C', 'E')

#Outputs
# ---------- end matrix_class_8 ----------
panel_11 = Panel(matrix_class_8)

# ==== cluster GHPythonRemote: Connects the Grasshopper Python component to an external Python instance.
python = PythonScript()  # -> gh_parent_doc_dir
# ---------- python: Python ----------
from os import path

gh_parent_doc_dir = path.abspath(path.dirname(ghenv.Component.OnPingDocument().Owner.OnPingDocument().FilePath))
# ---------- end python ----------
# GH to python remote example.
# Pierre Cuvilliers, 2017-2018
# Released under the MIT license
# github.com/pilcru/ghpythonremote
# Runs and connects to an external python engine, and
# assigns imported modules to scriptcontext.sticky variables.
# 
# Arguments:
#       code (str): Path to the GH_to_python_sticky.py code file.
#       location (str): Path to a python executable, or to a folder
#             containing `python.exe`, or the name of a conda-created
#             virtual environment prefixed by `conda://` (`conda://env_name`).
#             If empty, finds python from your windows %PATH%.
#       run (boolean): Creates the connection, and imports new
#             modules, when turned to True. Kills the connection,
#             and deletes the references to the imports, when turned
#             to False.
#       modules (str list): List of module names to import in the
#             remote python. They will be added to the
#             scriptcontext.sticky dictionary, allowing them to be
#             reused from other python components in the same
#             Grasshopper document. Submodules (for example
#             `numpy.linalg` have to be added explicitly to this list
#             to be available later.
#       log_level (str from ['NOTSET', 'DEBUG', 'INFO', 'WARNING', 'ERROR', 'CRITICAL']):
#             Logging level to use for the local IronPython and the
#             remote python instance.
#       working_dir (str): Working directory for the remote python
#             instance.
# 
# Returns:
#       out (str): Console output with DEBUG information.
#       linked_modules (str list): list of imported module names.
#       rpy (rpyc connection object): The object representing the
#             remote Python interpreter.
location = ClusterInput()  # location (str): Path to a python executable, or to a folder containing `python.exe`, or the name of a conda-created virtual environment prefixed by `conda://` (`conda://env_name`). If empty, finds python from your windows %PATH%.
run = ClusterInput()  # run (boolean): Creates the connection, and imports new modules, when turned to True. Kills the connection,and deletes the references to the imports, when turned to False.
modules = ClusterInput()  # modules (str list): List of module names to import in the remote python. They will be added to the scriptcontext.sticky dictionary, allowing them to be reused from other python components in the same Grasshopper document. Submodules (for example `numpy.linalg` have to be added explicitly to this list to be available later.
list = ValueList({"CRITICAL", "ERROR", "WARNING", "INFO", "DEBUG", "NOTSET"}, selected="DEBUG")
panel = Panel(python)
ghpythonremote = GHPythonRemote(location=location, run=run, modules=modules, log_level=list, working_dir=panel)  # -> out, linked_modules, rpy; inputs run: Boolean, modules: list
# ---------- ghpythonremote: Python ----------
import inspect
import logging
from os import path
import sys
from time import sleep

import scriptcontext

import ghpythonremote
from ghpythonremote.connectors import GrasshopperToPythonRemote

local_log_level = getattr(logging, log_level, logging.WARNING)
logger = logging.getLogger("ghpythonremote")
logger.setLevel(local_log_level)
ch = logging.StreamHandler()
ch.setLevel(local_log_level)
formatter = logging.Formatter("%(levelname)s: %(name)s:\n%(message)s")
ch.setFormatter(formatter)
logger.handlers = []
logger.addHandler(ch)
logger = logging.getLogger("ghpythonremote.GH_to_python")

ROOT = path.abspath(path.dirname(inspect.getfile(ghpythonremote)))
rpyc_server_py = path.join(ROOT, "pythonservice.py")

# Set connection to CLOSED if this is the first run
# and initialize set of linked modules
try:
    remote_python_status
except NameError:
    remote_python_status = "CLOSED"
    lkd_modules = set()

# Wait for connection to connect or terminate
timer = 0
while remote_python_status == "CONNECTING" or remote_python_status == "CLOSING":
    sleep(1)
    timer += 1
    if timer == 10:
        try:
            gh2py_manager.__exit__(*sys.exc_info())
        except Exception:
            pass
        remote_python_status = "CLOSED"
        lkd_modules = set()
        raise RuntimeError(
            "Connection left in an inconsistent state and not returning. Reset "
            "everything."
        )

if run:
    if not remote_python_status == "OPEN":
        remote_python_status = "CONNECTING"
        gh2py_manager = GrasshopperToPythonRemote(
            rpyc_server_py,
            location=location,
            timeout=10,
            port=None,
            log_level=log_level,
            working_dir=working_dir,
        )
        gh2py = gh2py_manager.__enter__()
        remote_python_status = "OPEN"

    # Stuff that we can reach
    rpymod = gh2py.py_remote_modules  # A getter function for a named python module
    rpy = gh2py.connection  # Represents the remote instance root object
    scriptcontext.sticky["rpy"] = rpy
    # Add modules
    for mod in modules:
        try:
            scriptcontext.sticky[mod] = rpymod(mod)
            lkd_modules.add(mod)
        except ImportError:
            gh2py_manager.__exit__(*sys.exc_info())
            raise

elif not remote_python_status == "CLOSED":
    remote_python_status = "CLOSING"
    # Remove linked modules
    for mod in lkd_modules:
        del scriptcontext.sticky[mod]
    del scriptcontext.sticky["rpy"]
    gh2py_manager.__exit__(*sys.exc_info())
    lkd_modules = set()
    remote_python_status = "CLOSED"

# Change variable name because ghpython resets outputs to None before each run
linked_modules = lkd_modules

logger.info("GH to python connection is {}".format(remote_python_status))
# ---------- end ghpythonremote ----------
out = ClusterOutput(ghpythonremote.out)  # Console output.
linked_modules = ClusterOutput(ghpythonremote.linked_modules)  # Names of modules that were successfully added to the scriptcontext.sticky dictionary.
rpy = ClusterOutput(ghpythonremote.rpy)  # The object representing the remote python instance
python_2 = PythonScript(module_names=ghpythonremote.linked_modules)  # -> import_statements; inputs module_names: list
# ---------- python_2: Python ----------
import_statements = ["import scriptcontext as sc"]
for module_name in module_names:
    import_statements.append("{0} = sc.sticky['{0}']".format(module_name))

if len(module_names) == 0:
    import_statements = []
# ---------- end python_2 ----------
import_statements = ClusterOutput(python_2)  # Useful import statements to use the imported modules in your scripts.
